# Grasshopper definition Compute_Tower_36.gh (Grasshopper 1.0.7)
# plug-ins: Weaverbird, MeshEdit Components

# ---- group: RH_IN:201:Inclinacion
number_slider = Slider(1.5, range=0..10)

# ---- group: RH_IN:201:ExtrusionExo
number_slider_2 = Slider(3.4, range=0..10)

# ---- group: RH_IN:201:Exo
number_slider_3 = Slider(0.7, range=0..1)

# ---- group: RH_IN:201:Ranura
number_slider_4 = Slider(2, range=0..10)

# ---- group: RH_IN:201:Entrecalle
number_slider_5 = Slider(0.2, range=0..1)

# ----
crv = Curve(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)
crv_2 = Curve([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])
pt = Point([Point(0, 0, 0), Point(0, 0, 0.2), Point(0, 0, 0.4), Point(0, 0, 5.825), Point(0, 0, 11.95), Point(0, 0, 18.075)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])
pt_2 = Point(Point(274.4225409, 108.1354463, 0))
crv_3 = Curve(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)
shift = ShiftList(List=pt, Shift=1, Wrap=False)
list = ValueList({"Small": 1, "Big": 0}, selected="Big")
shift_2 = ShiftList(List=shift, Shift=1, Wrap=False)
item = ListItem(List=shift, Index=0, Wrap=True)  # -> Item1, Item, Item1_2
neg = Negative(Value=number_slider)
pdecon = Deconstruct(Point=item.Item1_2)  # -> XComponent, YComponent, ZComponent
Z = UnitZ(Factor=pdecon.ZComponent)
move = Move(Geometry=pt_2, Motion=Z)  # -> Geometry, Transform
move_2 = Move(Geometry=crv_3, Motion=Z)  # -> Geometry, Transform
move_3 = Move(Geometry=crv, Motion=Z)  # -> Geometry, Transform
move_4 = Move(Geometry=crv_2, Motion=Z)  # -> Geometry, Transform
xz = XZPlane(Origin=move.Geometry)
pdecon_2 = Deconstruct(Point=item.Item1)  # -> XComponent, YComponent, ZComponent
cluster = Cluster(crv=move_2.Geometry, num=number_slider, G=list)  # -> flatten(R)
xy = XYPlane(Origin=shift_2)
offset = OffsetCurve(Curve=move_3.Geometry, Distance=neg, Plane=PlaneXY(0, 0, 0), Corners=1)
pcx = CurvePlane(Curve=reparameterize(move_2.Geometry), Plane=xz)  # -> Points, ParamsC, ParamsP
subtraction = Subtraction(A=pdecon_2.ZComponent, B=pdecon.ZComponent)
merge = Merge(Data1=move_3.Geometry, Data2=offset)  # -> flatten(Result)
ccx = CurveCurve(CurveA=reparameterize(graft(merge)), CurveB=move_4.Geometry)  # -> Points, ParamsA, ParamsB
pcx_2 = CurvePlane(Curve=reparameterize(cluster), Plane=xz)  # -> Points, ParamsC, ParamsP
Z_2 = UnitZ(Factor=subtraction)
pdecon_3 = Deconstruct(Point=pcx.Points)  # -> XComponent, YComponent, ZComponent
pshift = ShiftPaths(Data=ccx.ParamsA, Offset=-1)
extr = Extrude(Base=move_2.Geometry, Direction=Z_2)
sort = SortList(Keys=pdecon_3.XComponent, ValuesA=pcx.Points, ValuesB=pcx.ParamsC)  # -> Keys, ValuesA, ValuesB
pdecon_4 = Deconstruct(Point=pcx_2.Points)  # -> XComponent, YComponent, ZComponent
shatter = Shatter(Curve=reparameterize(graft(merge)), Parameters=pshift)
P = DispatchPattern([True, False])
item_2 = ListItem(List=sort.ValuesB, Index=0, Wrap=True)
sec = BrepPlane(Brep=extr, Plane=xy)  # -> Curves, Points
sort_2 = SortList(Keys=pdecon_4.XComponent, ValuesA=pcx_2.Points, ValuesB=pcx_2.ParamsC)  # -> Keys, ValuesA, ValuesB
not = GateNot(A=P)
seam = Seam(Curve=reparameterize(move_2.Geometry), Seam=item_2)
item_3 = ListItem(List=sort_2.ValuesB, Index=0, Wrap=True)
eval = EvaluateCurve(Curve=reparameterize(shatter), Parameter=Slider(0.5, range=0..1))  # -> Point, Tangent, Angle
pshift_2 = ShiftPaths(Data=ccx.Points, Offset=-1)
entwine = Entwine(Branch00=not, Branch01=P, FlattenInputs=True)
seam_2 = Seam(Curve=reparameterize(cluster), Seam=item_3)
weave = Weave(Pattern=[0, 1], Stream0=pshift_2, Stream1=eval.Point, NullGaps=False)
cir = Circle(Plane=pcx_2.Points, Radius=number_slider_4)
dispatch = Dispatch(List=weave, DispatchPattern=entwine)  # -> ListA, ListB
cir_2 = Circle(Plane=pcx.Points, Radius=number_slider_4)
bang = ExplodeTree(Data=weave)  # -> Branch0, Branch1
ccx_2 = CurveCurve(CurveA=cir, CurveB=reparameterize(seam_2))  # -> Points, ParamsA, ParamsB
bang_2 = ExplodeTree(Data=dispatch.ListB)  # -> Branch0, Branch1
ccx_3 = CurveCurve(CurveA=cir_2, CurveB=reparameterize(seam))  # -> Points, ParamsA, ParamsB
shatter_2 = Shatter(Curve=reparameterize(seam_2), Parameters=flatten(ccx_2.ParamsB))
shatter_3 = Shatter(Curve=reparameterize(seam), Parameters=flatten(ccx_3.ParamsB))
dispatch_2 = Dispatch(List=bang.Branch1, DispatchPattern=[True, False])  # -> ListA, ListB
pdecon_5 = Deconstruct(Point=ccx_3.Points)  # -> XComponent, YComponent, ZComponent
cir_3 = Circle(Plane=bang_2.Branch0, Radius=number_slider_5)
len = Length(Curve=shatter_2)
pt_3 = Point(dispatch_2.ListA)
points = PointList(Points=weave, Size=Slider(2, range=0..10))
sort_3 = SortList(Keys=pdecon_5.YComponent, ValuesA=ccx_3.Points)  # -> Keys, ValuesA
flip = FlipCurve(Curve=cir_3)  # -> Curve, Flag
sort_4 = SortList(Keys=len, ValuesA=shatter_2)  # -> Keys, ValuesA
pline = PolyLine(Vertices=sort_3.ValuesA, Closed=False)
ccx_4 = CurveCurve(CurveA=flip.Curve, CurveB=reparameterize(seam))  # -> Points, ParamsA, ParamsB
split = SplitList(List=sort_4.ValuesA, Index=Slider(2, range=0..10))  # -> ListA, ListB
end = EndPoints(Curve=pline)  # -> Start, End
eval_2 = EvaluateCurve(Curve=reparameterize(split.ListB), Parameter=Slider(0.5, range=0..1))  # -> Point, Tangent, Angle
sort_5 = SortList(Keys=flatten(ccx_4.ParamsB), ValuesA=flatten(ccx_4.Points))  # -> Keys, ValuesA
vec2pt = Vector2Pt(PointA=end.End, PointB=end.Start, Unitize=False)  # -> Vector, Length
pdecon_6 = Deconstruct(Point=eval_2.Point)  # -> XComponent, YComponent, ZComponent
pline_2 = PolyLine(Vertices=dispatch_2.ListA, Closed=False)
unflatten = UnflattenTree(Tree=sort_5.Keys, Guide=ccx_4.ParamsB)
unflatten_2 = UnflattenTree(Tree=sort_5.ValuesA, Guide=ccx_4.ParamsB)
sort_6 = SortList(Keys=pdecon_6.YComponent, ValuesA=split.ListB)  # -> Keys, ValuesA
pframe = PerpFrame(Curve=reparameterize(seam), Parameter=unflatten)
explode = Explode(Curve=pline_2, Recursive=True)  # -> Segments, Vertices
subtraction_2 = Subtraction(A=Slider(18.075, range=0..100), B=pdecon.ZComponent)
item_4 = ListItem(List=sort_6.ValuesA, Index=0, Wrap=True)  # -> Item1, Item
eval_3 = EvaluateCurve(Curve=reparameterize(explode.Segments), Parameter=Slider(0.5, range=0..1))  # -> Point, Tangent, Angle
Z_3 = UnitZ(Factor=subtraction_2)
move_5 = Move(Geometry=item_4.Item1, Motion=Z_3)  # -> Geometry, Transform
pline_3 = PolyLine(Vertices=unflatten_2, Closed=False)
move_6 = Move(Geometry=unflatten_2, Motion=Z_3)  # -> Geometry, Transform
end_2 = EndPoints(Curve=move_5.Geometry)  # -> Start, End
move_7 = Move(Geometry=eval_3.Point, Motion=Z_3)  # -> Geometry, Transform
item_5 = ListItem(List=move_6.Geometry, Index=0, Wrap=True)  # -> flatten(Item)
weave_2 = Weave(Pattern=[0, 1], Stream0=dispatch_2.ListA, Stream1=move_7.Geometry, NullGaps=False)
points_2 = PointList(Points=flatten(move_6.Geometry))
pline_4 = PolyLine(Vertices=weave_2, Closed=False)
entwine_2 = Entwine(Branch00=end_2.Start, Branch01=weave_2, Branch02=end_2.End, FlattenInputs=True)  # -> flatten(Result)
entwine_3 = Entwine(Branch00=end_2.Start, Branch01=move_7.Geometry, Branch02=end_2.End, FlattenInputs=True)  # -> flatten(Result)
explode_2 = Explode(Curve=pline_4, Recursive=True)  # -> Segments, Vertices
pline_5 = PolyLine(Vertices=entwine_2, Closed=False)
partition = PartitionList(List=explode_2.Segments, Size=Slider(2, range=0..10))
pline_6 = PolyLine(Vertices=entwine_3, Closed=False)
explode_3 = Explode(Curve=pline_5, Recursive=True)  # -> Segments, Vertices
join = JoinCurves(Curves=partition, Preserve=False)
partition_2 = PartitionList(List=explode_3.Segments, Size=Slider(2, range=0..10))
end_3 = EndPoints(Curve=join)  # -> Start, End
join_2 = JoinCurves(Curves=partition_2, Preserve=False)
ln = Line(StartPoint=end_3.Start, EndPoint=end_3.End)
merge_2 = Merge(Data1=join, Data2=ln)
end_4 = EndPoints(Curve=join_2)  # -> Start, End
join_3 = JoinCurves(Curves=merge_2, Preserve=False)
ln_2 = Line(StartPoint=end_4.Start, EndPoint=end_4.End)
md_slider = MDSlider(SliderMode=0, slider_value=Point(0.5, 0.5, 0.5), x_domain=Domain(0, 1), y_domain=Domain(0, 1), z_domain=Domain(0, 1))
merge_3 = Merge(Data1=join_2, Data2=ln_2)
boundary = BoundarySurfaces(Edges=join_3)
list_2 = ValueList({"Small": 1, "Big": 0}, selected="Small")
num = Number(number_slider_3)
join_4 = JoinCurves(Curves=merge_3, Preserve=False)
number_slider_6 = Slider(1, range=0..1)
wires = BrepWireframe(Brep=boundary, Density=-1)
join_5 = JoinCurves(Curves=flatten(join), Preserve=False)
join_6 = JoinCurves(Curves=flatten(join_2), Preserve=False)
boundary_2 = BoundarySurfaces(Edges=join_4)
evalsrf = EvaluateSurface(Surface=reparameterize(join_4), Point=md_slider)  # -> Point, Normal, UDirection, VDirection, Frame
join_7 = JoinCurves(Curves=wires, Preserve=False)
evalsrf_2 = EvaluateSurface(Surface=join_7, Point=md_slider)  # -> Point, Normal, UDirection, VDirection, Frame
cluster_2 = Cluster_2(crv=join, num=num, P=evalsrf_2.Frame, G=list_2)
cluster_3 = Cluster_3(crv=join, num=num, G=list_2)
end_5 = EndPoints(Curve=join_5)  # -> Start, End
end_6 = EndPoints(Curve=join_6)  # -> Start, End
ext = ExtendCurve(Curve=cluster_2, Type=0, Start=number_slider_6, End=number_slider_6)
cluster_4 = Cluster_2(crv=join_2, num=num, P=evalsrf.Frame, G=list_2)
line = LineSDL(Start=graft([end_5.Start, end_5.End]), Direction=vec2pt.Vector, Length=num)
line_2 = LineSDL(Start=graft([end_6.Start, end_6.End]), Direction=vec2pt.Vector, Length=num)
scx = SurfaceCurve(Surface=reparameterize(join_7), Curve=cluster_3)  # -> Curves, Points, UVPoints, Normals, Parameters, Tangents
scx_2 = SurfaceCurve(Surface=boundary_2, Curve=cluster_4)  # -> Curves, Points, UVPoints, Normals, Parameters, Tangents
join_8 = JoinCurves(Curves=scx.Curves, Preserve=False)
join_9 = JoinCurves(Curves=scx_2.Curves, Preserve=False)
join_10 = JoinCurves(Curves=scx.Curves, Preserve=False)
srfsplit = SurfaceSplit(Surface=boundary, Curves=scx.Curves)
pln = Plane(pframe)
srfsplit_2 = SurfaceSplit(Surface=boundary_2, Curves=scx_2.Curves)
end_7 = EndPoints(Curve=join_9)  # -> Start, End
merge_4 = Merge(Data1=simplify(join_9), Data2=simplify(join_2))
pframe_2 = PerpFrame(Curve=reparameterize([line, line_2]), Parameter=Slider(1, range=0..1))
merge_5 = Merge(Data1=simplify(join_8), Data2=simplify(join))
merge_6 = Merge(Data1=line_2, Data2=line)
end_8 = EndPoints(Curve=join_10)  # -> Start, End
disc = Discontinuity(Curve=join_9, Level=1)  # -> Points, Parameters
item_6 = ListItem(List=srfsplit, Index=0, Wrap=True)  # -> Item, Item1
loft = Loft(Curves=merge_5, Options={Adjust=False, Closed=False, LoftEnds=0, LoftSimp=0, LoftType=0, Rebuild=10, Refit=0.01})
ln_3 = Line(StartPoint=end_8.Start, EndPoint=end_8.End)
end_9 = EndPoints(Curve=join_9)  # -> flatten(Start), flatten(End)
loft_2 = Loft(Curves=merge_4, Options={Adjust=False, Closed=False, LoftEnds=0, LoftSimp=0, LoftType=0, Rebuild=10, Refit=0.01})
item_7 = ListItem(List=srfsplit_2, Index=0, Wrap=True)  # -> Item, Item1
merge_7 = Merge(Data1=simplify(end_7.Start), Data2=simplify(end_7.End))
panel = Panel("""0
1""")
pcx_3 = CurvePlane(Curve=reparameterize(graft(scx_2.Curves)), Plane=graft(pln))  # -> Points, ParamsC, ParamsP
merge_8 = Merge(Data1=simplify(end_4.Start), Data2=simplify(end_7.Start))
item_8 = ListItem(List=disc.Points, Index=Slider(1, range=0..1), Wrap=True)
merge_9 = Merge(Data1=simplify(end_4.End), Data2=simplify(end_7.End))
pcx_4 = CurvePlane(Curve=join_9, Plane=pln)  # -> Points, ParamsC, ParamsP
area = Area(Geometry=srfsplit)  # -> Area, Centroid
flip_2 = Flip(Surface=loft)  # -> Surface, Result
debrep = DeconstructBrep(Brep=loft)  # -> Faces, Edges, Vertices
area_2 = Area(Geometry=srfsplit_2)  # -> Area, Centroid
pframe_3 = PerpFrame(Curve=reparameterize(ln_3), Parameter=panel)
Z_4 = UnitZ(Factor=1)
flip_3 = Flip(Surface=loft_2)  # -> Surface, Result
align = AlignPlane(Plane=pframe_2, Direction=Z_4)  # -> Plane, Angle
pline_7 = PolyLine(Vertices=merge_7, Closed=False)
pline_8 = PolyLine(Vertices=merge_9, Closed=False)
pline_9 = PolyLine(Vertices=merge_8, Closed=False)
weave_3 = Weave(Pattern=[0, 1], Stream0=end_9.Start, Stream1=end_9.End, NullGaps=False)
pt_4 = Point(move_6.Geometry)
shatter_4 = Shatter(Curve=reparameterize(graft(scx_2.Curves)), Parameters=pcx_3.ParamsC)
sort_7 = SortList(Keys=area.Area, ValuesA=srfsplit)  # -> Keys, ValuesA
sort_8 = SortList(Keys=area_2.Area, ValuesA=srfsplit_2)  # -> Keys, ValuesA
align_2 = AlignPlane(Plane=pframe_3, Direction=Z_4)  # -> Plane, Angle
deplane = DeconstructPlane(Plane=align.Plane)  # -> Origin, XAxis, YAxis, ZAxis
merge_10 = Merge(Data1=pline_9, Data2=pline_8)
panel_2 = Panel("""0
1""")
merge_11 = Merge(Data1=simplify(graft(pcx_4.Points)), Data2=simplify(graft(pt_4)))
points_3 = PointList(Points=weave_3)
bang_3 = ExplodeTree(Data=deplane.YAxis)  # -> _0000, _0001
item_9 = ListItem(List=sort_7.ValuesA, Index=0, Wrap=True)
item_10 = ListItem(List=sort_8.ValuesA, Index=0, Wrap=True)
deplane_2 = DeconstructPlane(Plane=align_2.Plane)  # -> Origin, XAxis, YAxis, ZAxis
len_2 = Length(Curve=shatter_4)
pframe_4 = PerpFrame(Curve=pline_7, Parameter=panel_2)
Z_5 = UnitZ(Factor=1)
weave_4 = Weave(Pattern=[0, 1, 1, 0], Stream0=weave_3, Stream1=flatten(pt_4), NullGaps=False)
rev = Reverse(Vector=bang_3._0000)
sort_9 = SortList(Keys=len_2, ValuesA=shatter_4)  # -> Keys, ValuesA
pline_10 = PolyLine(Vertices=merge_11, Closed=False)
brep = Brep([item_10, item_9])
align_3 = AlignPlane(Plane=pframe_4, Direction=Z_5)  # -> Plane, Angle
num_2 = Number(number_slider_2)
merge_12 = Merge(Data1=rev, Data2=bang_3._0001)
item_11 = ListItem(List=sort_9.ValuesA, Index=Slider(1, range=0..1), Wrap=True)
deplane_3 = DeconstructPlane(Plane=align_3.Plane)  # -> Origin, XAxis, YAxis, ZAxis
line_3 = LineSDL(Start=deplane_2.Origin, Direction=deplane_2.YAxis, Length=num_2)
line_4 = LineSDL(Start=deplane.Origin, Direction=merge_12, Length=num_2)
pshift_3 = ShiftPaths(Data=pline_10, Offset=-1)
partition_3 = PartitionList(List=weave_4, Size=Slider(4, range=0..10))
item_12 = ListItem(List=line_4, Index=Slider(1, range=0..1), Wrap=True)
line_5 = LineSDL(Start=deplane_3.Origin, Direction=deplane_3.YAxis, Length=num_2)
pline_11 = PolyLine(Vertices=partition_3, Closed=False)
number_slider_7 = Slider(1, range=0..1)
explode_4 = Explode(Curve=pline_11, Recursive=True)  # -> Segments, Vertices
item_13 = ListItem(List=explode_4.Segments, Index=number_slider_7, Wrap=True)
cull_i = CullIndex(List=explode_4.Segments, Indices=number_slider_7, Wrap=True)
merge_13 = Merge(Data1=simplify(item_11), Data2=simplify(graft(cull_i)), Data3=simplify(graft(pshift_3)))
eval_4 = EvaluateCurve(Curve=reparameterize(item_13), Parameter=Slider(0.5, range=0..1))  # -> Point, Tangent, Angle
num_3 = Number(subtraction)
merge_14 = Merge(Data1=simplify(item_8), Data2=simplify(eval_4.Point))
boundary_3 = BoundarySurfaces(Edges=merge_13)
subtraction_3 = Subtraction(A=num_3, B=subtraction_2)
dispatch_3 = Dispatch(List=flatten(boundary_3), DispatchPattern=[True, False])  # -> ListA, ListB
pline_12 = PolyLine(Vertices=merge_14, Closed=False)
flip_4 = Flip(Surface=dispatch_3.ListA)  # -> Surface, Result
Z_6 = UnitZ(Factor=subtraction_3)
weave_5 = Weave(Pattern=[0, 1], Stream0=pshift_3, Stream1=pline_12, NullGaps=False)
merge_15 = Merge(Data1=flip_4.Surface, Data2=dispatch_3.ListB)
extr_2 = Extrude(Base=merge_10, Direction=Z_6)
dispatch_4 = Dispatch(List=flatten(extr_2), DispatchPattern=[True, False])  # -> ListA, ListB
md_slider_2 = MDSlider(SliderMode=0, slider_value=Point(0.5, 0.5, 0.5), x_domain=Domain(0, 1), y_domain=Domain(0, 1), z_domain=Domain(0, 1))
flip_5 = Flip(Surface=dispatch_4.ListB)  # -> Surface, Result
loft_3 = Loft(Curves=weave_5, Options={Adjust=False, Closed=False, LoftEnds=0, LoftSimp=0, LoftType=3, Rebuild=10, Refit=0.01})
extr_3 = Extrude(Base=line_2, Direction=Z_6)
extr_4 = Extrude(Base=item_12, Direction=Z_6)
loft_4 = Loft(Curves=merge_6, Options={Adjust=False, Closed=False, LoftEnds=0, LoftSimp=0, LoftType=0, Rebuild=10, Refit=0.01})
loft_5 = Loft(Curves=line_4, Options={Adjust=False, Closed=False, LoftEnds=0, LoftSimp=0, LoftType=0, Rebuild=10, Refit=0.01})
merge_16 = Merge(Data1=dispatch_4.ListA, Data2=flip_5.Surface)
debrep_2 = DeconstructBrep(Brep=loft_3)  # -> Faces, Edges, Vertices
extr_5 = Extrude(Base=pline_11, Direction=Z_6)
item_14 = ListItem(List=flatten(extr_3), Index=0, Wrap=True)  # -> Item, Item1
flip_6 = Flip(Surface=debrep_2.Faces)  # -> Surface, Result
item_15 = ListItem(List=flatten(loft_4), Index=0, Wrap=True)  # -> Item, Item1
swp1 = Sweep1(Rail=join_9, Sections=line_5, Miter=1)
swp1_2 = Sweep1(Rail=join_10, Sections=line_3, Miter=1)
extr_6 = Extrude(Base=line_5, Direction=Z_6)
item_16 = ListItem(Index=0, Wrap=True)
debrep_3 = DeconstructBrep(Brep=extr_5)  # -> Faces, Edges, Vertices
brep_2 = Brep([flip_3.Surface, debrep.Faces])
flip_7 = Flip(Surface=item_14.Item)  # -> Surface, Result
flip_8 = Flip(Surface=item_15.Item1)  # -> Surface, Result
brep_3 = Brep([flip_7.Surface, item_14.Item1])
brep_4 = Brep([item_15.Item, flip_8.Surface])
evalsrf_3 = EvaluateSurface(Surface=reparameterize(brep_4), Point=md_slider_2)  # -> Point, Normal, UDirection, VDirection, Frame
vdis = VectorDisplay(Anchor=evalsrf_3.Point, Vector=evalsrf_3.Normal)
crv_4 = Curve(sec.Curves)
list_3 = ValueList({"Small": 1, "Big": 0}, selected="Small")
crv_5 = Curve([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])
pt_5 = Point(Point(274.4225409, 108.1354463, 0))
pt_6 = ConstructPoint(XCoordinate=0, YCoordinate=0, ZCoordinate=0)
brep_5 = Brep([merge_15, debrep_3.Faces])
brep_6 = Brep([swp1, merge_16, flip_6.Surface, brep_2, swp1_2, brep_3, extr_4, loft_5, brep_4, merge_15, debrep_3.Faces, extr_6])
xz_2 = XZPlane(Origin=pt_5)
brep_7 = Brep([swp1, extr_6, merge_16, merge_15, debrep_3.Faces, flip_6.Surface, brep_2, swp1_2, brep_3, extr_4, loft_5, brep_4])
brep_8 = Brep([merge_16, flip_6.Surface, brep_2, brep_3, brep_4])
boundary_4 = BoundarySurfaces(Edges=crv_5)
cluster_5 = Cluster_2(crv=crv_4, num=Slider(0.3, range=0..1), P=crv_4, G=list_3)
Z_7 = UnitZ(Factor=num_3)
mirror = Mirror(Geometry=brep_5, Plane=xz_2)  # -> Geometry, Transform
vec2pt_2 = Vector2Pt(PointA=pt_5, PointB=pt_6, Unitize=False)  # -> Vector, Length
move_8 = Move(Geometry=boundary_4, Motion=Z)  # -> Geometry, Transform
mirror_2 = Mirror(Geometry=brep_8, Plane=xz_2)  # -> Geometry, Transform
divide = DivideCurve(Curve=cluster_5, Count=Slider(20, range=0..100), Kinks=False)  # -> Points, Tangents, Parameters
boundary_5 = BoundarySurfaces(Edges=cluster_5)
number_slider_8 = Slider(0.1, range=0..0.1)
brep_9 = Brep([mirror.Geometry, brep_5])
brep_10 = Brep([brep_8, mirror_2.Geometry])
debrep_4 = DeconstructBrep(Brep=flatten(brep_10))  # -> flatten(Faces), Edges, Vertices
extr_7 = Extrude(Base=move_8.Geometry, Direction=Z_7)
Z_8 = UnitZ(Factor=Slider(-0.4, range=-1..0))
area_3 = Area(Geometry=boundary_5)  # -> Area, Centroid
pline_13 = PolyLine(Vertices=divide.Points, Closed=True)
debrep_5 = DeconstructBrep(Brep=extr_7)  # -> flatten(Faces), Edges, Vertices
number_slider_9 = Slider(0.02, range=0..0.1)
xy_2 = XYPlane(Origin=area_3.Centroid)
boundary_6 = BoundarySurfaces(Edges=pline_13)
mesh = MeshBrep(
    Brep=debrep_4.Faces,
    Settings={GridMaxCount=0, GridMinCount=16, JaggedSeams=False, MaxEdgeLength=0, MinEdgeLength=0.0001, MinTolerance=0, Refine=True, RefineAngle=0, RelativeTolerance=0.65, SimplePlanes=True, Tolerance=0})
extr_8 = Extrude(Base=boundary_6, Direction=Z_8)
mesh_2 = MeshBrep(
    Brep=debrep_5.Faces,
    Settings={GridMaxCount=0, GridMinCount=16, JaggedSeams=False, MaxEdgeLength=0, MinEdgeLength=0.0001, MinTolerance=0, Refine=True, RefineAngle=0, RelativeTolerance=0.65, SimplePlanes=True, Tolerance=0})
unifynormals = MeshUnifyNormals(Mesh=mesh)
del = DelaunayMesh(Points=divide.Points, Plane=xy_2)
mjoin = MeshJoin(Meshes=flatten(brep_9))
smesh = SimpleMesh(Brep=flatten([brep_10, extr_7]))
mesh_3 = MeshBrep(
    Brep=extr_8,
    Settings={GridMaxCount=0, GridMinCount=16, JaggedSeams=False, MaxEdgeLength=0, MinEdgeLength=0.0001, MinTolerance=0, Refine=True, RefineAngle=0, RelativeTolerance=0.65, SimplePlanes=True, Tolerance=0})
mjoin_2 = MeshJoin(Meshes=flatten([mesh_3, mesh, mesh_2]))
weldvertices = MeshWeldVertices(Mesh=unifynormals, Tolerance=0.01)  # -> RuntimeMessage, Mesh
facen = FaceNormals(Mesh=mesh_2)  # -> Centers, Normals
wbthicken = WeaverbirdsMeshThicken(MeshCurves=mesh, Distance=number_slider_9, OffsetType=0)
weld = WeldMesh(Mesh=weldvertices.Mesh, Angle=3.141592654)
vdis_2 = VectorDisplay(Anchor=facen.Centers, Vector=facen.Normals)
panel_3 = Panel(brep_10)
alignvert = AlignVertices(Mesh=weld, Tolerance=0.01)  # -> Result, Count
flip_9 = MeshFlip(Mesh=weld)
explode_5 = MeshExplode(Mesh=flip_9, Interpolate=False)
wbthicken_2 = WeaverbirdsMeshThicken(MeshCurves=explode_5, Distance=number_slider_9, OffsetType=0)
mjoin_3 = MeshJoin(Meshes=flatten(wbthicken))
wbsplitquads = WeaverbirdsConstantQuadsSplitSubdivision(MeshCurves=explode_5, Level=1, SmoothNakedEdges=Slider(0, range=0..100))
unifynormals_2 = MeshUnifyNormals(Mesh=mjoin_3)
xz_3 = XZPlane(Origin=Point(0, 0, 0))
xz_4 = XZPlane(Origin=Point(0, 0, 0))
facen_2 = FaceNormals(Mesh=wbthicken)  # -> Centers, Normals
move_9 = Move(Geometry=mjoin, Motion=vec2pt_2.Vector)  # -> Geometry, Transform
move_10 = Move(Geometry=mjoin_2, Motion=vec2pt_2.Vector)  # -> Geometry, Transform
pflip = FlipPlane(Plane=xz_3, ReverseX=False, ReverseY=True, SwapAxes=False)
pflip_2 = FlipPlane(Plane=xz_4, ReverseX=False, ReverseY=True, SwapAxes=False)
vdis_3 = VectorDisplay(Anchor=facen_2.Centers, Vector=facen_2.Normals)
orient = Orient(Geometry=move_9.Geometry, Source=PlaneXY(0, 0, 0), Target=pflip)  # -> Geometry, Transform
orient_2 = Orient(Geometry=move_10.Geometry, Source=PlaneXY(0, 0, 0), Target=pflip_2)  # -> Geometry, Transform
mjoin_4 = MeshJoin(Meshes=flatten(orient_2.Geometry))
mjoin_5 = MeshJoin(Meshes=flatten(orient.Geometry))
flipm = FlipMesh(Mesh=mjoin_4, VertexNormals=True, FaceNormals=True, FaceOrientation=True)

# ---- group: RH_OUT:115:Mesh_Glass
mesh_4 = Mesh(mjoin_5)

# ---- group: RH_OUT:115:Hotel
mesh_5 = Mesh(mjoin_4)

# ==== cluster Cluster
G = ClusterInput()
crv = ClusterInput()
num = ClusterInput()
crv_2 = Curve(crv)
num_2 = Number(num)
offset = OffsetCurve(Curve=crv_2, Distance=num_2, Plane=PlaneXY(0, 0, 0), Corners=1)
area = Area(Geometry=crv_2)  # -> Area, Centroid
area_2 = Area(Geometry=offset)  # -> Area, Centroid
eval = Evaluate(F="x<y", x=area.Area, y=area_2.Area)
not = GateNot(A=eval)
filter = StreamFilter(Gate=G, Stream0=eval, Stream1=not)
cull = CullPattern(List=crv_2, CullPattern=invert(filter))
cull_2 = CullPattern(List=offset, CullPattern=filter)
neg = Negative(Value=num_2)
offset_2 = OffsetCurve(Curve=cull, Distance=neg, Plane=PlaneXY(0, 0, 0), Corners=1)
merge = Merge(Data1=simplify(offset_2), Data2=simplify(cull_2))
R = ClusterOutput(merge)

# ==== cluster Cluster_2
G = ClusterInput()
crv = ClusterInput()
num = ClusterInput()
P = ClusterInput()
crv_2 = Curve(crv)
num_2 = Number(num)
len = Length(Curve=crv_2)
offset = OffsetCurve(Curve=crv_2, Distance=num_2, Plane=P, Corners=1)
len_2 = Length(Curve=offset)
eval = Evaluate(F="x<y", x=len, y=len_2)
not = GateNot(A=eval)
filter = StreamFilter(Gate=G, Stream0=eval, Stream1=not)
cull = CullPattern(List=crv_2, CullPattern=invert(filter))
cull_2 = CullPattern(List=offset, CullPattern=filter)
neg = Negative(Value=num_2)
offset_2 = OffsetCurve(Curve=cull, Distance=neg, Plane=P, Corners=1)
merge = Merge(Data1=simplify(offset_2), Data2=simplify(cull_2))
R = ClusterOutput(merge)

# ==== cluster Cluster_3
G = ClusterInput()
crv = ClusterInput()
num = ClusterInput()
crv_2 = Curve(crv)
num_2 = Number(num)
len = Length(Curve=crv_2)
offset = OffsetCurve(Curve=crv_2, Distance=num_2, Plane=PlaneXY(0, 0, 0), Corners=1)
len_2 = Length(Curve=offset)
eval = Evaluate(F="x<y", x=len, y=len_2)
not = GateNot(A=eval)
filter = StreamFilter(Gate=G, Stream0=eval, Stream1=not)
cull = CullPattern(List=crv_2, CullPattern=invert(filter))
cull_2 = CullPattern(List=offset, CullPattern=filter)
neg = Negative(Value=num_2)
offset_2 = OffsetCurve(Curve=cull, Distance=neg, Plane=PlaneXY(0, 0, 0), Corners=1)
merge = Merge(Data1=simplify(offset_2), Data2=simplify(cull_2))
R = ClusterOutput(merge)
