# Grasshopper definition Compute_Tower_39.gh (Grasshopper 1.0.7)
# plug-ins: UserDataUtils, Kangaroo2 Components, Weaverbird, Kangaroo Components, MeshEdit Components

srf = Surface([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])

# ---- group: ORIGINAL
srf_2 = Surface([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])

# ---- group: Finales
srf_3 = Surface([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])

# ----
wires = BrepWireframe(Brep=srf_3, Density=-1)
area = Area(Geometry=srf_3)  # -> Area, Centroid
join = JoinCurves(Curves=wires, Preserve=False)  # -> flatten(Curves)
pdecon = Deconstruct(Point=area.Centroid)  # -> XComponent, YComponent, ZComponent
sort = SortList(Keys=pdecon.ZComponent, ValuesA=join)  # -> Keys, ValuesA
panel = Panel(sort.Keys)
item = ListItem(List=sort.ValuesA, Index=Slider(47, range=0..100), Wrap=True)
item_2 = ListItem(List=sort.ValuesA, Index=Slider(26, range=0..100), Wrap=True)
item_3 = ListItem(List=sort.ValuesA, Index=Slider(1, range=0..1), Wrap=True)
item_4 = ListItem(List=sort.ValuesA, Index=Slider(71, range=0..100), Wrap=True)
project = Project(Geometry=item_3, Plane=PlaneXY(0, 0, 0))  # -> Geometry, Transform
project_2 = Project(Geometry=item_2, Plane=PlaneXY(0, 0, 0))  # -> Geometry, Transform
project_3 = Project(Geometry=item, Plane=PlaneXY(0, 0, 0))  # -> Geometry, Transform
project_4 = Project(Geometry=item_4, Plane=PlaneXY(0, 0, 0))  # -> Geometry, Transform
loft = Loft(Curves=sort.ValuesA, Options={Adjust=False, Closed=False, LoftEnds=0, LoftSimp=0, LoftType=0, Rebuild=10, Refit=0.01})
neg = Negative(Value=Slider(1.3, range=0..100))
cluster = Cluster(crv=flatten(item_2), num=neg)
area_2 = Area(Geometry=loft)  # -> Area, Centroid
yz = YZPlane(Origin=Point(0, 0, 0))
xz = XZPlane(Origin=Point(0, 0, 0))
crvprox = CurveProximity(CurveA=project_2.Geometry, CurveB=project.Geometry)  # -> PointA, PointB, Distance
crvprox_2 = CurveProximity(CurveA=project_2.Geometry, CurveB=project_3.Geometry)  # -> PointA, PointB, Distance
crvprox_3 = CurveProximity(CurveA=project_2.Geometry, CurveB=project_4.Geometry)  # -> PointA, PointB, Distance
panel_2 = Panel(area_2.Area)
pcx = CurvePlane(Curve=flatten(cluster), Plane=yz)  # -> Points, ParamsC, ParamsP
pcx_2 = CurvePlane(Curve=flatten(cluster), Plane=xz)  # -> Points, ParamsC, ParamsP
pdecon_2 = Deconstruct(Point=pcx.Points)  # -> XComponent, YComponent, ZComponent
number_slider = Slider(1, range=0..1)
pdecon_3 = Deconstruct(Point=pcx_2.Points)  # -> XComponent, YComponent, ZComponent
sort_2 = SortList(Keys=pdecon_2.YComponent, ValuesA=pcx.ParamsC, ValuesB=pcx.Points)  # -> Keys, ValuesA, ValuesB
sort_3 = SortList(Keys=pdecon_3.XComponent, ValuesA=pcx_2.ParamsC, ValuesB=pcx_2.Points)  # -> Keys, ValuesA, ValuesB
number_slider_2 = Slider(1, range=0..100)
item_5 = ListItem(List=sort_2.ValuesA, Index=number_slider, Wrap=True)
item_6 = ListItem(List=sort_2.ValuesB, Index=number_slider, Wrap=True)
item_7 = ListItem(List=sort_3.ValuesA, Index=0, Wrap=True)
number_slider_3 = Slider(16, range=0..100)
seam = Seam(Curve=flatten(cluster), Seam=item_5)
seam_2 = Seam(Curve=flatten(cluster), Seam=item_5)
number_slider_4 = Slider(8, range=0..100)
seam_3 = Seam(Curve=flatten(cluster), Seam=item_7)
seam_4 = Seam(Curve=flatten(cluster), Seam=item_7)
filter = StreamFilter(Gate=number_slider_2, Stream0=Slider(16, range=0..100), Stream1=Slider(10, range=0..100))
pt = Point(area.Centroid)
divide = DivideCurve(Curve=seam, Count=number_slider_3, Kinks=False)  # -> Points, Tangents, Parameters
divide_2 = DivideCurve(Curve=seam_3, Count=number_slider_3, Kinks=False)  # -> Points, Tangents, Parameters
divide_3 = DivideCurve(Curve=seam_2, Count=filter, Kinks=False)  # -> Points, Tangents, Parameters
divide_4 = DivideCurve(Curve=seam_4, Count=filter, Kinks=False)  # -> Points, Tangents, Parameters
dispatch = Dispatch(List=divide_3.Points, DispatchPattern=[True, False])  # -> ListA, ListB
project_5 = Project(Geometry=divide_2.Points, Plane=PlaneXY(0, 0, 0))  # -> Geometry, Transform
dispatch_2 = Dispatch(List=divide_4.Points, DispatchPattern=[True, False])  # -> ListA, ListB
filter_2 = StreamFilter(Gate=number_slider_2, Stream0=Slider(-2, range=-10..0), Stream1=Slider(-3, range=-10..0))
pdecon_4 = Deconstruct(Point=pt)  # -> XComponent, YComponent, ZComponent
project_6 = Project(Geometry=divide.Points, Plane=PlaneXY(0, 0, 0))  # -> Geometry, Transform
neg_2 = Negative(Value=Slider(-3, range=-10..0))
pt_2 = Point(dispatch.ListB)
range = Range(Domain=Domain(0, 1), Steps=Slider(6, range=0..10))
sort_4 = SortList(Keys=pdecon_4.ZComponent)  # -> Keys, ValuesA
neg_3 = Negative(Value=filter_2)
pt_3 = Point(dispatch_2.ListA)
graph = GraphMapper(
    range,
    x0=0,
    x1=1,
    y0=0,
    y1=1,
    container_name="Bezier",
    cpx=[0, 0.3223703802, 0.6708427072, 1],
    cpy=[0, 0.2583466172, 0.5874242783, 1])
number_slider_5 = Slider(6, range=0..10)
number_slider_6 = Slider(1, range=0..1)
shift = ShiftList(List=project_6.Geometry, Shift=neg_2, Wrap=True)
filter_3 = StreamFilter(Gate=number_slider_2, Stream0=pt_3, Stream1=divide_4.Points)
filter_4 = StreamFilter(Gate=number_slider_2, Stream0=pt_2, Stream1=divide_3.Points)
lng = ListLength(List=sort_4.Keys)
project_7 = Project(Geometry=filter_3, Plane=PlaneXY(0, 0, 0))  # -> Geometry, Transform
project_8 = Project(Geometry=filter_4, Plane=PlaneXY(0, 0, 0))  # -> Geometry, Transform
division = Division(A=lng, B=number_slider_5)
dom = ConstructDomain(DomainStart=number_slider_6, DomainEnd=lng)
graph_2 = GraphMapper(
    range,
    x0=0,
    x1=1,
    y0=0,
    y1=1,
    container_name="Bezier",
    cpx=[0, 0.5446796417, 0.7484784722, 1],
    cpy=[0, 0.1623684764, 0.580129981, 1])
graph_3 = GraphMapper(range, x0=0, x1=1, y0=0, y1=1, Cx=0.5434782505, Cy=0.4782608747, container_name="Conic")
series = Series(Start=Slider(1, range=0..1), Step=division, Count=number_slider_5)
range_2 = Range(Domain=Domain(0, 1), Steps=Slider(3, range=0..10))
shift_2 = ShiftList(List=project_8.Geometry, Shift=neg_3, Wrap=True)
graph_4 = GraphMapper(
    range_2,
    x0=0,
    x1=1,
    y0=0,
    y1=1,
    A=1,
    B=0,
    container_name="Linear",
    Graph_x0=0.25,
    Graph_x1=0.75,
    Graph_y0=0.25,
    Graph_y1=0.75)
number_slider_7 = Slider(-1, range=-1..0)
remap = RemapNumbers(Value=graph_2, Source=Domain(0, 1), Target=dom)  # -> Mapped, Clipped
round = Round(Number=remap.Mapped)  # -> Nearest, Floor, Ceiling
shift_3 = ShiftList(List=graph_4, Shift=1, Wrap=False)
cull_i = CullIndex(List=graph_4, Indices=number_slider_7, Wrap=True)
shift_4 = ShiftList(List=round.Nearest, Shift=1, Wrap=False)
subtraction = Subtraction(A=shift_3, B=cull_i)
panel_3 = Panel("""3
2
1""")
subtraction_2 = Subtraction(A=shift_4, B=Slider(1, range=0..1))
merge = Merge(Data1=number_slider_6, Data2=subtraction_2)  # -> flatten(Result)
division_2 = Division(A=graft(subtraction), B=graft(panel_3))
dup = DuplicateData(Data=division_2, Number=graft(panel_3), Order=True)
cull_i_2 = CullIndex(List=merge, Indices=number_slider_7, Wrap=True)
dom_2 = ConstructDomain(DomainStart=0, DomainEnd=lng)
panel_4 = Panel(cull_i_2)
python = GhPythonScript(x=flatten(dup))  # -> out, a; inputs x: list
# ---------- python: Python ----------
__author__ = "Arquitectura"
__version__ = "2020.05.14"

import rhinoscriptsyntax as rs

list = []
count = 0
list.append(count)
for i in range(len(x)-1):
    count += x[i]
    list.append(count)

a= list
# ---------- end python ----------
remap_2 = RemapNumbers(Value=flatten(python.a), Source=Domain(0, 1), Target=dom_2)  # -> Mapped, Clipped
round_2 = Round(Number=remap_2.Mapped)  # -> Nearest, Floor, Ceiling
shift_5 = ShiftList(List=cull_i_2, Shift=1, Wrap=False)
cull_i_3 = CullIndex(List=cull_i_2, Indices=number_slider_7, Wrap=True)
panel_5 = Panel(python.a)
addition = Addition(A=round_2.Nearest, B=Slider(1, range=0..1))
subtraction_3 = Subtraction(A=shift_5, B=cull_i_3)
replace = ReplaceItems(List=round_2.Nearest, Item=Slider(1, range=0..1), Indices=Slider(0, range=0..100), Wrap=False)
panel_6 = Panel(subtraction_3)
item_8 = ListItem(List=sort_4.Keys, Index=cull_i_2, Wrap=True)
number_slider_8 = Slider(0, range=0..1)
number_slider_9 = Slider(112, range=0..1000)
number_slider_10 = Slider(112, range=0..1000)
number_slider_11 = Slider(112, range=0..1000)
item_9 = ListItem(List=item_8, Index=0, Wrap=True)  # -> Item, Item1, Item2, Item3, Item4, Item5
subtraction_4 = Subtraction(A=item_9.Item, B=Slider(0, range=-10..1))
subtraction_5 = Subtraction(A=item_9.Item1, B=Slider(0, range=-10..1))
number_slider_12 = Slider(204.4, range=0..1000)
subtraction_6 = Subtraction(A=item_9.Item5, B=Slider(0, range=-10..1))
subtraction_7 = Subtraction(A=item_9.Item3, B=Slider(0, range=-10..1))
number_slider_13 = Slider(204.4, range=0..1000)
Z = UnitZ(Factor=subtraction_4)
pt_4 = Point(shift_2)
Z_2 = UnitZ(Factor=subtraction_5)
Z_3 = UnitZ(Factor=subtraction_6)
number_slider_14 = Slider(1, range=0..100)
num = Number(number_slider_14)
filter_5 = StreamFilter(Gate=num, Stream1=shift_2)
Z_4 = UnitZ(Factor=subtraction_7)
move = Move(Geometry=filter_5, Motion=Z)  # -> Geometry, Transform
subtraction_8 = Subtraction(A=Slider(310.45, range=0..1000), B=Slider(-0.2, range=-10..1))
subtraction_9 = Subtraction(A=item_9.Item4, B=Slider(0, range=-10..1))
subtraction_10 = Subtraction(A=item_9.Item2, B=Slider(0, range=-10..1))
filter_6 = StreamFilter(Gate=num, Stream1=pt_4)
filter_7 = StreamFilter(Gate=num, Stream1=pt_4)
filter_8 = StreamFilter(Gate=num, Stream1=pt_4)
filter_9 = StreamFilter(Gate=number_slider_14, Stream1=project_7.Geometry)
filter_10 = StreamFilter(Gate=number_slider_14, Stream1=project_7.Geometry)
filter_11 = StreamFilter(Gate=number_slider_14, Stream1=project_7.Geometry)
Z_5 = UnitZ(Factor=subtraction_8)
Z_6 = UnitZ(Factor=subtraction_9)
Z_7 = UnitZ(Factor=subtraction_10)
move_2 = Move(Geometry=filter_7, Motion=Z_5)  # -> Geometry, Transform
move_3 = Move(Geometry=filter_8, Motion=Z_6)  # -> Geometry, Transform
move_4 = Move(Geometry=filter_6, Motion=Z_7)  # -> Geometry, Transform
move_5 = Move(Geometry=filter_9, Motion=Z_2)  # -> Geometry, Transform
move_6 = Move(Geometry=filter_11, Motion=Z_4)  # -> Geometry, Transform
move_7 = Move(Geometry=filter_10, Motion=Z_3)  # -> Geometry, Transform
entwine = Entwine(
    Branch00=move.Geometry,
    Branch01=move_5.Geometry,
    Branch02=move_4.Geometry,
    Branch03=move_6.Geometry,
    Branch04=move_3.Geometry,
    Branch05=move_7.Geometry,
    Branch06=move_2.Geometry,
    FlattenInputs=True)
pt_5 = Point(entwine)
pline = PolyLine(Vertices=pt_5, Closed=True)
brep = Brep([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])
item_10 = ListItem(List=flatten(pline), Index=0, Wrap=True)
area_3 = Area(Geometry=pline)  # -> Area, Centroid

# ---- group: RH_IN:201:Count
number_slider_15 = Slider(1.2, range=0..10)

# ----
number_slider_16 = Slider(1.2, range=-2..100)
xy = XYPlane(Origin=area_3.Centroid)
list = ValueList({"Small": 1, "Big": 0}, selected="Big")
sec = BrepPlane(Brep=brep, Plane=xy)  # -> Curves, Points
sec_2 = BrepPlane(Brep=loft, Plane=xy)  # -> Curves, Points
filter_12 = StreamFilter(Gate=number_slider_2, Stream0=Slider(1.1, range=-2..100), Stream1=number_slider_15)
flip = FlipCurve(Curve=sec_2.Curves)  # -> Curve, Flag
neg_4 = Negative(Value=filter_12)
pshift = ShiftPaths(Data=sec.Curves, Offset=-1)

# ---- group: RH_IN:201:Length
number_slider_17 = Slider(0.5, range=0..10)

# ----
number_slider_18 = Slider(0.5, range=0..1)

# ---- group: RH_IN:201:Radius
number_slider_19 = Slider(0.5, range=0..10)

# ----
cluster_2 = Cluster(crv=flip.Curve, num=neg_4)
number_slider_20 = Slider(0.5, range=0..1)
cluster_3 = Cluster_3(crv=flip.Curve, num=filter_12, G=list)
area_4 = Area(Geometry=pshift)  # -> Area, Centroid
pdecon_5 = Deconstruct(Point=area_3.Centroid)  # -> XComponent, YComponent, ZComponent
number_slider_21 = Slider(5, range=0..10)
project_9 = Project(Geometry=area_4.Centroid, Plane=PlaneXY(0, 0, 0))  # -> Geometry, Transform
Z_8 = UnitZ(Factor=pdecon_5.ZComponent)
X = UnitX(Factor=1)
pt_6 = ConstructPoint(XCoordinate=0, YCoordinate=0, ZCoordinate=0)
tstat = TreeStatistics(Tree=cluster_3)  # -> Paths, Length, Count
offset = OffsetCurve(Curve=cluster_3, Distance=Slider(0.3, range=0..1), Plane=PlaneXY(0, 0, 0), Corners=1)
Y = UnitY(Factor=1)
rev = Reverse(Vector=X)
filter_13 = StreamFilter(Gate=number_slider_2, Stream0=Slider(0, range=-2..100), Stream1=number_slider_19)
filter_14 = StreamFilter(Gate=number_slider_2, Stream0=Slider(0, range=-2..100), Stream1=number_slider_17)
vec2pt = Vector2Pt(PointA=pt_6, PointB=graft(project_9.Geometry), Unitize=False)  # -> Vector, Length
item_11 = ListItem(List=tstat.Paths, Index=number_slider_21, Wrap=True)  # -> Item, Item1
pl = ConstructPlane(Origin=Point(0, 0, 0), XAxis=rev, YAxis=Y)
int = Integer(number_slider_21)
int_2 = Integer(expr("x+1", int))
angle = Angle(VectorA=vec2pt.Vector, VectorB=rev, Plane=pl)  # -> Angle, Reflex
branch = TreeBranch(Tree=cluster_3, Path=item_11.Item, MaintainPaths=True)
list_2 = ValueList({"Small": 1, "Big": 0}, selected="Small")
branch_2 = TreeBranch(Tree=cluster_3, Path=item_11.Item1, MaintainPaths=True)
list_3 = ValueList({"Small": 1, "Big": 0}, selected="Big")
merge_2 = Merge(Data1=int, Data2=int_2)  # -> flatten(Result)
pshift_2 = ShiftPaths(Data=angle.Angle, Offset=-1)
cluster_4 = Cluster_3(crv=branch, num=filter_14, G=list_2)
cluster_5 = Cluster_3(crv=branch_2, num=filter_13, G=list_3)
sort_5 = SortList(Keys=pshift_2, ValuesA=project_9.Geometry)  # -> Keys, ValuesA, ValuesB
pline_2 = PolyLine(Vertices=sort_5.ValuesA, Closed=True)
merge_3 = Merge(Data1=cluster_4, Data2=cluster_5)  # -> flatten(Result)
explode = Explode(Curve=pline_2, Recursive=True)  # -> Segments, Vertices
eval = EvaluateCurve(Curve=reparameterize(explode.Segments), Parameter=Slider(0.5, range=0..1))  # -> Point, Tangent, Angle
replace_2 = ReplaceItems(List=flatten(cluster_3), Item=merge_3, Indices=merge_2, Wrap=False)  # -> simplify(graft(List))
weave = Weave(Pattern=[0, 1], Stream0=sort_5.ValuesA, Stream1=eval.Point, NullGaps=False)
crv = Curve(replace_2)
pshift_3 = ShiftPaths(Data=weave, Offset=-1)
tstat_2 = TreeStatistics(Tree=pshift_3)  # -> Paths, Length, Count
panel_7 = Panel("""True
False
False
True
False
False
False
True
False
False
False
False
False
True
False
False
False
True
False
False""")
dispatch_3 = Dispatch(List=tstat_2.Paths, DispatchPattern=[True, False])  # -> ListA, ListB
area_5 = Area(Geometry=sort.ValuesA)  # -> Area, Centroid
panel_8 = Panel("True")
branch_3 = TreeBranch(Tree=pshift_3, Path=dispatch_3.ListA, MaintainPaths=True)
panel_9 = Panel("""True
False
False
False
True
False
False
False
False
True
False
False
False
False
True
False
False
False""")
rev_2 = ReverseList(List=panel_7)
item_12 = ListItem(List=tstat_2.Paths, Index=0, Wrap=True)  # -> Item, Item1
branch_4 = TreeBranch(Tree=pshift_3, Path=dispatch_3.ListB, MaintainPaths=True)
shift_6 = ShiftList(List=sort.ValuesA, Shift=1, Wrap=False)
shift_7 = ShiftList(List=area_5.Centroid, Shift=1, Wrap=False)
shift_8 = ShiftList(List=branch_4, Shift=Slider(-1, range=-1..0), Wrap=True)
cull = CullPattern(List=branch_3, CullPattern=panel_9)
split = SplitList(List=cull, Index=Slider(5, range=0..10))  # -> ListA, ListB
cull_2 = CullPattern(List=shift_8, CullPattern=panel_7)
xz_2 = XZPlane(Origin=Point(0, 0, 0))
pt_7 = Point(split.ListA)
mirror = Mirror(Geometry=split.ListA, Plane=xz_2)  # -> Geometry, Transform
rev_3 = ReverseList(List=mirror.Geometry)
merge_4 = Merge(Data1=pt_7, Data2=rev_3)
points = PointList(Points=merge_4)
points_2 = PointList(Points=cull_2)
merge_5 = Merge(Data1=merge_4, Data2=cull_2)
pshift_4 = ShiftPaths(Data=merge_5, Offset=-1)

move_8 = Move(Geometry=pshift_4, Motion=Z_8)  # -> Geometry, Transform
pt_8 = Point(pt_5)

tstat_3 = TreeStatistics(Tree=pt_8)  # -> Paths, Length, Count
panel_10 = Panel("""-1
-2""")
crv_2 = Curve(crv)
item_13 = ListItem(List=tstat_3.Paths, Index=panel_10, Wrap=True)
item_14 = ListItem(List=flatten(crv_2), Index=0, Wrap=True)  # -> Item1, Item
branch_5 = TreeBranch(Tree=pt_8, Path=item_13, MaintainPaths=True)  # -> flatten(Branch)
crv_cp = CurveClosestPoint(Point=pt_8, Curve=crv_2)  # -> Point, Parameter, Distance
crv_cp_2 = CurveClosestPoint(Point=branch_5, Curve=item_14.Item1)  # -> Point, Parameter, Distance
curvature = Curvature(Curve=crv_2, Parameter=crv_cp.Parameter)  # -> P, K, C
curvature_2 = Curvature(Curve=item_14.Item1, Parameter=crv_cp_2.Parameter)  # -> P, K, C
line = LineSDL(Start=curvature.P, Direction=curvature.K, Length=Slider(41.45, range=0..100))
darc = DeconstructArc(Arc=curvature_2.C)  # -> BasePlane, Radius, Angle
line_2 = LineSDL(Start=curvature_2.P, Direction=curvature_2.K, Length=Slider(41.45, range=0..100))
tstat_4 = TreeStatistics(Tree=line)  # -> Paths, Length, Count
deplane = DeconstructPlane(Plane=darc.BasePlane)  # -> Origin, XAxis, YAxis, ZAxis
item_15 = ListItem(List=tstat_4.Paths, Index=panel_10, Wrap=True)
shift_9 = ShiftList(List=tstat_4.Paths, Shift=Slider(-1, range=-1..0), Wrap=False)
duppt = RemoveDuplicatePts(Points=deplane.Origin, Tolerance=0.01)
branch_6 = TreeBranch(Tree=line, Path=shift_9, MaintainPaths=True)  # -> flatten(Branch)
cso = CreateACustomSpeckleObject(amazingness=<missing>, transparency=<missing>, color=<missing>)  # -> SpeckleObject, Dictionary
pt_9 = Point(pt_8)
sbc = SchemaBuilderComponent(
    assembly="SpeckleCoreGeometryClasses.SpeckleBrep, SpeckleCoreGeometryClasses, Version=1.3.15.139, Culture=neutral, PublicKeyToken=null",
    init=True,
    type="SpeckleBrep")
cso_2 = CreateACustomSpeckleObject(Amazingness=<missing>)  # -> SpeckleObject, Dictionary
crv_cp_3 = CurveClosestPoint(Point=pt_9, Curve=crv_2)  # -> Point, Parameter, Distance
crv_cp_4 = CurveClosestPoint(Point=pt_9, Curve=crv_2)  # -> Point, Parameter, Distance
sudso = SetUserDataSpeckleObject(SpeckleObject=flatten(<missing>), UserData=cso_2.Dictionary)
sudso_2 = SetUserDataSpeckleObject(SpeckleObject=flatten(<missing>), UserData=cso.Dictionary)
tstat_5 = TreeStatistics(Tree=crv_cp_3.Point)  # -> Paths, Length, Count
pline_3 = PolyLine(Vertices=crv_cp_4.Point, Closed=True)
points_3 = PointList(Points=crv_cp_4.Point)
shift_10 = ShiftList(List=tstat_5.Paths, Shift=1, Wrap=False)
tstat_6 = TreeStatistics(Tree=crv_cp_4.Point)  # -> Paths, Length, Count
anonymous_stream = DataSender(A=sudso, B=sudso_2, C=<missing>, DebouncingDisabled=False, manualmode=False, remotecontroller=True)  # -> Log, StreamId; disabled
area_6 = Area(Geometry=pline_3)  # -> Area, Centroid
dispatch_4 = Dispatch(List=shift_10, DispatchPattern=invert([True, False]))  # -> ListA, ListB
dispatch_5 = Dispatch(List=shift_10, DispatchPattern=[True, False])  # -> ListA, ListB
dispatch_6 = Dispatch(List=tstat_6.Paths, DispatchPattern=invert([True, False]))  # -> ListA, ListB
dispatch_7 = Dispatch(List=tstat_6.Paths, DispatchPattern=[True, False])  # -> ListA, ListB
sort_6 = SortList(Keys=flatten(area_6.Area), ValuesA=flatten(pline_3))  # -> Keys, ValuesA
short = ShortestList(ListA=dispatch_5.ListA, ListB=dispatch_5.ListB, TrimMode=2)  # -> ListA, ListB
item_16 = ListItem(List=flatten(pline_3), Index=0, Wrap=True)  # -> Item1, Item
pdecon_6 = Deconstruct(Point=flatten(area_6.Centroid))  # -> XComponent, YComponent, ZComponent
short_2 = ShortestList(ListA=dispatch_7.ListA, ListB=dispatch_7.ListB, TrimMode=2)  # -> ListA, ListB
short_3 = ShortestList(ListA=dispatch_4.ListA, ListB=dispatch_4.ListB, TrimMode=2)  # -> ListA, ListB
short_4 = ShortestList(ListA=dispatch_6.ListA, ListB=dispatch_6.ListB, TrimMode=2)  # -> ListA, ListB
item_17 = ListItem(List=sort_6.ValuesA, Index=0, Wrap=True)  # -> Item2, Item1, Item
number_slider_22 = Slider(0, range=-1..0)
number_slider_23 = Slider(-1, range=-1..0)
branch_7 = TreeBranch(Tree=crv_cp_3.Point, Path=short.ListB, MaintainPaths=True)
branch_8 = TreeBranch(Tree=crv_cp_3.Point, Path=short.ListA, MaintainPaths=True)
crv_3 = Curve(item_16.Item1)
crv_4 = Curve(item_17.Item1)
branch_9 = TreeBranch(Tree=crv_cp_4.Point, Path=short_2.ListB, MaintainPaths=True)
branch_10 = TreeBranch(Tree=crv_cp_3.Point, Path=short_3.ListB, MaintainPaths=True)
branch_11 = TreeBranch(Tree=crv_cp_3.Point, Path=short_3.ListA, MaintainPaths=True)
branch_12 = TreeBranch(Tree=crv_cp_4.Point, Path=short_2.ListA, MaintainPaths=True)
crv_5 = Curve([item_17.Item1, item_17.Item2])
branch_13 = TreeBranch(Tree=crv_cp_4.Point, Path=short_4.ListB, MaintainPaths=True)
branch_14 = TreeBranch(Tree=crv_cp_4.Point, Path=short_4.ListA, MaintainPaths=True)
anonymous_stream_2 = DataReceiver(deserialize=True)  # -> _9a971776Abc546c39f061e0e56ae4340, _687cb2a187014aee84aeDe382e3fa13b, _578c7a72583145d0A64944a28518ec96
explode_2 = Explode(Curve=crv_4, Recursive=True)  # -> Segments, Vertices
shift_11 = ShiftList(List=branch_8, Shift=Slider(1, range=0..1), Wrap=True)
shift_12 = ShiftList(List=branch_12, Shift=Slider(-1, range=-1..0), Wrap=True)
shift_13 = ShiftList(List=branch_11, Shift=Slider(-1, range=-1..0), Wrap=True)
shift_14 = ShiftList(List=branch_14, Shift=Slider(1, range=0..1), Wrap=True)
eval_2 = EvaluateCurve(Curve=reparameterize(explode_2.Segments), Parameter=Slider(0.5, range=0..1))  # -> Point, Tangent, Angle
len = Length(Curve=explode_2.Segments)
ln = Line(StartPoint=shift_11, EndPoint=branch_7)
ln_2 = Line(StartPoint=branch_8, EndPoint=branch_7)
ln_3 = Line(StartPoint=shift_12, EndPoint=branch_9)
ln_4 = Line(StartPoint=branch_12, EndPoint=branch_9)
ln_5 = Line(StartPoint=shift_13, EndPoint=branch_10)
ln_6 = Line(StartPoint=branch_11, EndPoint=branch_10)
ln_7 = Line(StartPoint=shift_14, EndPoint=branch_13)
ln_8 = Line(StartPoint=branch_14, EndPoint=branch_13)
sort_7 = SortList(Keys=flatten(len))  # -> Keys, ValuesA
merge_6 = Merge(Data1=simplify(graft(ln_2)), Data2=simplify(graft(ln)))
merge_7 = Merge(Data1=simplify(graft(ln_4)), Data2=simplify(graft(ln_3)))
merge_8 = Merge(Data1=simplify(graft(ln_6)), Data2=simplify(graft(ln_5)))
merge_9 = Merge(Data1=simplify(graft(ln_8)), Data2=simplify(graft(ln_7)))
item_18 = ListItem(List=sort_7.Keys, Index=0, Wrap=True)  # -> Item1, Item
loft_2 = Loft(Curves=merge_6, Options={Adjust=False, Closed=False, LoftEnds=0, LoftSimp=0, LoftType=0, Rebuild=10, Refit=0.01})
loft_3 = Loft(Curves=merge_8, Options={Adjust=False, Closed=False, LoftEnds=0, LoftSimp=0, LoftType=0, Rebuild=10, Refit=0.01})
loft_4 = Loft(Curves=merge_7, Options={Adjust=False, Closed=False, LoftEnds=0, LoftSimp=0, LoftType=0, Rebuild=10, Refit=0.01})
loft_5 = Loft(Curves=merge_9, Options={Adjust=False, Closed=False, LoftEnds=0, LoftSimp=0, LoftType=0, Rebuild=10, Refit=0.01})
division_3 = Division(A=item_18.Item1, B=Slider(2, range=0..10))
flip_2 = FlipCurve(Curve=merge_6)  # -> Curve, Flag
pshift_5 = ShiftPaths(Data=loft_2, Offset=-1)
pshift_6 = ShiftPaths(Data=loft_4, Offset=-1)
pshift_7 = ShiftPaths(Data=loft_5, Offset=-1)
pshift_8 = ShiftPaths(Data=loft_3, Offset=-1)
merge_10 = Merge(Data1=pshift_6, Data2=pshift_7)
merge_11 = Merge(Data1=pshift_5, Data2=pshift_8)
tstat_7 = TreeStatistics(Tree=merge_10)  # -> Paths, Length, Count
tstat_8 = TreeStatistics(Tree=merge_11)  # -> Paths, Length, Count
dispatch_8 = Dispatch(List=tstat_7.Paths, DispatchPattern=[True, False])  # -> ListA, ListB
dispatch_9 = Dispatch(List=tstat_8.Paths, DispatchPattern=[True, False])  # -> ListA, ListB
number_slider_24 = Slider(0, range=-1..0)
branch_15 = TreeBranch(Tree=merge_10, Path=dispatch_8.ListA, MaintainPaths=True)
branch_16 = TreeBranch(Tree=merge_10, Path=dispatch_8.ListB, MaintainPaths=True)
branch_17 = TreeBranch(Tree=merge_11, Path=dispatch_9.ListA, MaintainPaths=True)
branch_18 = TreeBranch(Tree=merge_11, Path=dispatch_9.ListB, MaintainPaths=True)
weave_2 = Weave(Pattern=[0, 1], Stream0=branch_15, Stream1=branch_16, NullGaps=False)
shift_15 = ShiftList(List=branch_18, Shift=1, Wrap=True)
weave_3 = Weave(Pattern=[0, 1], Stream0=branch_17, Stream1=shift_15, NullGaps=False)
entwine_2 = Entwine(Branch0X=merge_10, Branch1X=merge_11, FlattenInputs=False)
md_slider = MDSlider(SliderMode=0, slider_value=Point(0.5, 0.5, 0.5), x_domain=Domain(0, 1), y_domain=Domain(0, 1), z_domain=Domain(0, 1))
wires_2 = BrepWireframe(Brep=entwine_2, Density=-1)
join_2 = JoinCurves(Curves=wires_2, Preserve=False)
evalsrf = EvaluateSurface(Surface=reparameterize(entwine_2), Point=md_slider)  # -> Point, Normal, UDirection, VDirection, Frame
amp = Amplitude(Vector=evalsrf.Normal, Amplitude=Slider(0.2, range=0..1))
range_3 = Range(Domain=Domain(0, 1), Steps=Slider(5, range=0..10))
join_3 = BrepJoin(Breps=flatten(entwine_2))  # -> Breps, Closed
range_4 = Range(Domain=Domain(0, 1), Steps=Slider(6, range=0..10))
move_9 = Move(Geometry=evalsrf.Point, Motion=amp)  # -> Geometry, Transform
graph_5 = GraphMapper(range_3, x0=0, x1=1, y0=0, y1=1, Cx=0.5, Cy=0.5, container_name="Conic")
cap = CapHoles(Brep=join_3.Breps)
graph_6 = GraphMapper(range_4, x0=0, x1=1, y0=0, y1=1, Cx=0.5, Cy=0.5, container_name="Conic")
dom_3 = ConstructDomain(DomainStart=Slider(0.6, range=0..10), DomainEnd=Slider(0.2, range=0..1))
dom_4 = ConstructDomain(DomainStart=Slider(0.6, range=0..10), DomainEnd=Slider(0.2, range=0..1))
pshift_9 = ShiftPaths(Data=join_2, Offset=Slider(-2, range=-10..0))
brepinc = PointInBrep(Brep=cap, Point=move_9.Geometry, Strict=False)
xy_2 = XYPlane(Origin=shift_7)
number_slider_25 = Slider(2, range=0..10)
remap_3 = RemapNumbers(Value=graph_5, Source=Domain(0, 1), Target=dom_3)  # -> Mapped, Clipped
cull_3 = CullPattern(List=evalsrf.Normal, CullPattern=invert(brepinc))
remap_4 = RemapNumbers(Value=graph_6, Source=Domain(0, 1), Target=dom_4)  # -> Mapped, Clipped
cull_4 = CullPattern(List=evalsrf.Normal, CullPattern=brepinc)
lng_2 = ListLength(List=pshift_9)
sec_3 = BrepPlane(Brep=flatten(join_3.Breps), Plane=xy_2)  # -> flatten(Curves), Points
rev_4 = Reverse(Vector=cull_3)
shift_16 = ShiftList(List=remap_4.Mapped, Shift=1, Wrap=False)
shift_17 = ShiftList(List=remap_4.Mapped, Shift=Slider(-1, range=-1..0), Wrap=False)
weave_4 = Weave(Pattern=[0, 1], Stream0=shift_17, Stream1=shift_16, NullGaps=False)
weave_5 = Weave(Pattern=[0, 1], Stream0=shift_16, Stream1=shift_17, NullGaps=False)
partition = PartitionList(List=weave_4, Size=Slider(2, range=0..10))
partition_2 = PartitionList(List=weave_5, Size=Slider(2, range=0..10))
dup_2 = DuplicateData(Data=graft(remap_3.Mapped), Number=number_slider_25, Order=True)  # -> flatten(Data)
tstat_9 = TreeStatistics(Tree=lng_2)  # -> Paths, Length, Count
explode_3 = Explode(Curve=sec_3.Curves, Recursive=True)  # -> Segments, Vertices
merge_12 = Merge(Data1=cull_4, Data2=rev_4)
tstat_10 = TreeStatistics(Tree=partition)  # -> Paths, Length, Count
tstat_11 = TreeStatistics(Tree=partition_2)  # -> Paths, Length, Count
repeat = RepeatData(Data=shift_16, Length=tstat_9.Count)  # -> simplify(Data)
dup_3 = DuplicateData(Data=graft(shift_17), Number=number_slider_25, Order=True)  # -> flatten(Data)
dispatch_10 = Dispatch(List=shift_17, DispatchPattern=[True, False])  # -> ListA, ListB
dispatch_11 = Dispatch(List=shift_16, DispatchPattern=[True, False])  # -> ListA, ListB
dup_4 = DuplicateData(Data=graft(shift_16), Number=number_slider_25, Order=True)  # -> flatten(Data)
duppt_2 = RemoveDuplicatePts(Points=explode_3.Vertices, Tolerance=0.01)
repeat_2 = RepeatData(Data=graft(dup_2), Length=lng_2)
dispatch_12 = Dispatch(List=tstat_10.Paths, DispatchPattern=[True, False])  # -> ListA, ListB
dispatch_13 = Dispatch(List=tstat_11.Paths, DispatchPattern=[True, False])  # -> ListA, ListB
entwine_3 = Entwine(Branch00=dispatch_10.ListA, Branch01=dispatch_10.ListB, FlattenInputs=True)  # -> flatten(Result)
entwine_4 = Entwine(Branch00=dispatch_11.ListA, Branch01=dispatch_11.ListB, FlattenInputs=True)  # -> flatten(Result)
pline_4 = PolyLine(Vertices=duppt_2, Closed=True)
panel_11 = Panel(dup_2)
repeat_3 = RepeatData(Data=graft(dup_3), Length=lng_2)
repeat_4 = RepeatData(Data=graft(repeat), Length=lng_2)  # -> simplify(Data)
merge_13 = Merge(Data1=dispatch_12.ListA, Data2=dispatch_12.ListB)
merge_14 = Merge(Data1=dispatch_13.ListA, Data2=dispatch_13.ListB)
branch_19 = TreeBranch(Tree=partition, Path=merge_13, MaintainPaths=False)  # -> flatten(Branch)
unflatten = UnflattenTree(Tree=branch_19, Guide=lng_2)
repeat_5 = RepeatData(Data=unflatten, Length=lng_2)  # -> simplify(Data)
branch_20 = TreeBranch(Tree=partition_2, Path=merge_14, MaintainPaths=False)  # -> flatten(Branch)
unflatten_2 = UnflattenTree(Tree=branch_20, Guide=lng_2)
repeat_6 = RepeatData(Data=unflatten_2, Length=lng_2)  # -> simplify(Data)
unflatten_3 = UnflattenTree(Tree=flatten(repeat_4), Guide=join_2)
unflatten_4 = UnflattenTree(Tree=flatten(repeat_3), Guide=join_2)
panel_12 = Panel(lng_2)
boundary = BoundarySurfaces(Edges=graft([pline_4, crv_3]))

unflatten_5 = UnflattenTree(Tree=flatten(repeat_6), Guide=join_2)

unflatten_6 = UnflattenTree(Tree=flatten(repeat_2), Guide=join_2)

panel_13 = Panel(entwine_3)
unflatten_7 = UnflattenTree(Tree=flatten(repeat_5), Guide=join_2)
panel_14 = Panel("""2
3""")
cluster_6 = Cluster_2(crv=[pline_4, crv_3], num=Slider(0.3, range=0..1))
panel_15 = Panel(branch_20)
cluster_7 = Cluster_2(crv=join_2, num=unflatten_4)
area_7 = Area(Geometry=boundary)  # -> Area, Centroid
cluster_8 = Cluster_2(crv=join_2, num=unflatten_3)
cull_i_4 = CullIndex(List=flatten(cluster_6), Indices=panel_14, Wrap=True)
boundary_2 = BoundarySurfaces(Edges=graft(cull_i_4))
explode_4 = Explode(Curve=cluster_7, Recursive=True)  # -> Segments, Vertices
cluster_9 = Cluster_2(crv=join_2, num=unflatten_7)
explode_5 = Explode(Curve=cluster_8, Recursive=True)  # -> Segments, Vertices
ma = MassAddition(Input=flatten(area_7.Area))  # -> Result, PartialResults
cluster_10 = Cluster_2(crv=join_2, num=Slider(0.7, range=0..2))
cluster_11 = Cluster_2(crv=join_2, num=Slider(0.7, range=0..2))
area_8 = Area(Geometry=cull_i_4)  # -> Area, Centroid
disc = Discontinuity(Curve=cull_i_4, Level=1)  # -> Points, Parameters
area_9 = Area(Geometry=cull_i_4)  # -> Area, Centroid
Z_9 = UnitZ(Factor=Slider(0.4, range=0..1))
Z_10 = UnitZ(Factor=1)
end = EndPoints(Curve=explode_4.Segments)  # -> graft(Start), graft(End)
panel_16 = Panel(ma.Result)
Z_11 = UnitZ(Factor=1)
end_2 = EndPoints(Curve=explode_5.Segments)  # -> graft(Start), graft(End)
explode_6 = Explode(Curve=cluster_9, Recursive=True)  # -> Segments, Vertices
ma_2 = MassAddition(Input=flatten(area_8.Area))  # -> Result, PartialResults
explode_7 = Explode(Curve=cluster_11, Recursive=True)  # -> Segments, Vertices
extr = Extrude(Base=boundary_2, Direction=Z_9)
md_slider_2 = MDSlider(SliderMode=0, slider_value=Point(0.5, 0.5, 0.5), x_domain=Domain(0, 1), y_domain=Domain(0, 1), z_domain=Domain(0, 1))
xy_3 = XYPlane(Origin=area_9.Centroid)  # -> graft(Plane)
vec2pt_2 = Vector2Pt(PointA=end.Start, PointB=end.End, Unitize=False)  # -> Vector, Length
vec2pt_3 = Vector2Pt(PointA=end_2.Start, PointB=end_2.End, Unitize=False)  # -> Vector, Length
Z_12 = UnitZ(Factor=1)
end_3 = EndPoints(Curve=explode_6.Segments)  # -> graft(Start), graft(End)
debrep = DeconstructBrep(Brep=extr)  # -> Faces, Edges, Vertices
Z_13 = UnitZ(Factor=1)
end_4 = EndPoints(Curve=explode_7.Segments)  # -> graft(Start), graft(End)
mesh = MeshBrep(
    Brep=extr,
    Settings={GridMaxCount=0, GridMinCount=16, JaggedSeams=False, MaxEdgeLength=0, MinEdgeLength=0.0001, MinTolerance=0, Refine=True, RefineAngle=0, RelativeTolerance=0.65, SimplePlanes=True, Tolerance=0})
angle_2 = Angle(VectorA=vec2pt_2.Vector, VectorB=Z_10)  # -> Angle, Reflex
del = DelaunayMesh(Points=disc.Points, Plane=graft(xy_3))
wires_3 = BrepWireframe(Brep=graft(debrep.Faces), Density=-1)
angle_3 = Angle(VectorA=vec2pt_3.Vector, VectorB=Z_11)  # -> Angle, Reflex
vec2pt_4 = Vector2Pt(PointA=end_3.Start, PointB=end_3.End, Unitize=False)  # -> Vector, Length
evalsrf_2 = EvaluateSurface(Surface=reparameterize(debrep.Faces), Point=md_slider_2)  # -> Point, Normal, UDirection, VDirection, Frame
vec2pt_5 = Vector2Pt(PointA=end_4.Start, PointB=end_4.End, Unitize=False)  # -> Vector, Length
deg = Degrees(Radians=angle_2.Angle)
join_4 = JoinCurves(Curves=wires_3, Preserve=False)
deg_2 = Degrees(Radians=angle_3.Angle)
item_19 = ListItem(List=flatten(del), Index=0, Wrap=True)  # -> Item, Item1
angle_4 = Angle(VectorA=vec2pt_4.Vector, VectorB=Z_12)  # -> Angle, Reflex
round_3 = Round(Number=deg)  # -> Nearest, Floor, Ceiling
angle_5 = Angle(VectorA=vec2pt_5.Vector, VectorB=Z_13)  # -> Angle, Reflex
mjoin = MeshJoin(Meshes=flatten(del))
round_4 = Round(Number=deg_2)  # -> Nearest, Floor, Ceiling
deg_3 = Degrees(Radians=angle_4.Angle)
explode_8 = Explode(Curve=join_4, Recursive=True)  # -> Segments, Vertices
deg_4 = Degrees(Radians=angle_5.Angle)
equals = Equality(FirstNumber=round_3.Nearest, SecondNumber=Slider(90, range=0..100))  # -> Equality, Inequality
equals_2 = Equality(FirstNumber=round_4.Nearest, SecondNumber=Slider(90, range=0..100))  # -> Equality, Inequality
round_5 = Round(Number=deg_3)  # -> Nearest, Floor, Ceiling
round_6 = Round(Number=deg_4)  # -> Nearest, Floor, Ceiling
duppt_3 = RemoveDuplicatePts(Points=explode_8.Vertices, Tolerance=0.01)
cull_5 = CullPattern(List=graft(explode_4.Segments), CullPattern=invert(equals.Equality))
cull_6 = CullPattern(List=graft(explode_4.Segments), CullPattern=equals.Equality)
cull_7 = CullPattern(List=graft(explode_5.Segments), CullPattern=invert(equals_2.Equality))
cull_8 = CullPattern(List=graft(explode_5.Segments), CullPattern=equals_2.Equality)
equals_3 = Equality(FirstNumber=round_5.Nearest, SecondNumber=Slider(90, range=0..100))  # -> Equality, Inequality
number_slider_26 = Slider(1, range=0..1)
equals_4 = Equality(FirstNumber=round_6.Nearest, SecondNumber=Slider(90, range=0..100))  # -> Equality, Inequality
del_2 = DelaunayMesh(Points=duppt_3, Plane=graft(evalsrf_2.Frame))  # -> flatten(Mesh)
pshift_10 = ShiftPaths(Data=cull_5, Offset=-1)  # -> graft(Data)
del_3 = DelaunayMesh(Points=duppt_3, Plane=graft(evalsrf_2.Frame))
pshift_11 = ShiftPaths(Data=cull_7, Offset=-1)  # -> graft(Data)
cull_9 = CullPattern(List=graft(explode_6.Segments), CullPattern=invert(equals_3.Equality))
cull_10 = CullPattern(List=graft(explode_6.Segments), CullPattern=equals_3.Equality)
pshift_12 = ShiftPaths(Data=simplify(del_3), Offset=-1)
cull_11 = CullPattern(List=graft(explode_7.Segments), CullPattern=invert(equals_4.Equality))
cull_12 = CullPattern(List=graft(explode_7.Segments), CullPattern=equals_4.Equality)
end_5 = EndPoints(Curve=pshift_11)  # -> Start, End
end_6 = EndPoints(Curve=pshift_10)  # -> Start, End
mjoin_2 = MeshJoin(Meshes=pshift_12)  # -> flatten(Mesh)
pshift_13 = ShiftPaths(Data=cull_9, Offset=-1)
pshift_14 = ShiftPaths(Data=cull_11, Offset=-1)
number_slider_27 = Slider(5, range=0..10)
merge_15 = Merge(Data1=end_5.Start, Data2=end_5.End)
merge_16 = Merge(Data1=end_6.Start, Data2=end_6.End)
number_slider_28 = Slider(5, range=0..10)
item_20 = ListItem(List=pshift_14, Index=0, Wrap=True)  # -> Item, Item1
item_21 = ListItem(List=pshift_13, Index=0, Wrap=True)  # -> Item, Item1
join_5 = JoinCurves(Curves=pshift_13, Preserve=False)
pdecon_7 = Deconstruct(Point=merge_16)  # -> XComponent, YComponent, ZComponent
pdecon_8 = Deconstruct(Point=merge_15)  # -> XComponent, YComponent, ZComponent
item_22 = ListItem(List=mjoin_2, Index=Slider(1, range=0..1), Wrap=True)
join_6 = JoinCurves(Curves=pshift_14, Preserve=False)
ccx = CurveCurve(CurveA=item_20.Item, CurveB=item_20.Item1)  # -> Points, ParamsA, ParamsB
ccx_2 = CurveCurve(CurveA=item_21.Item, CurveB=item_21.Item1)  # -> Points, ParamsA, ParamsB
sort_8 = SortList(Keys=pdecon_8.ZComponent, ValuesA=merge_15)  # -> Keys, ValuesA
sort_9 = SortList(Keys=pdecon_7.ZComponent, ValuesA=merge_16)  # -> Keys, ValuesA
ext = ExtendCurve(Curve=join_5, Type=0, Start=number_slider_27, End=number_slider_27)
ext_2 = ExtendCurve(Curve=join_6, Type=0, Start=number_slider_28, End=number_slider_28)
item_23 = ListItem(List=sort_8.ValuesA, Index=Slider(1, range=0..1), Wrap=True)
item_24 = ListItem(List=sort_9.ValuesA, Index=0, Wrap=True)
ln_9 = Line(StartPoint=item_23, EndPoint=item_24)
explode_9 = Explode(Curve=join_2, Recursive=True)  # -> Segments, Vertices
cull_13 = CullPattern(List=graft(explode_9.Segments), CullPattern=equals_3.Equality)
cull_14 = CullPattern(List=graft(explode_9.Segments), CullPattern=equals_4.Equality)
pshift_15 = ShiftPaths(Data=cull_13, Offset=-1)
pshift_16 = ShiftPaths(Data=cull_14, Offset=-1)
ccx_3 = CurveCurve(CurveA=pshift_15, CurveB=ext)  # -> Points, ParamsA, ParamsB
ccx_4 = CurveCurve(CurveA=pshift_16, CurveB=ext_2)  # -> Points, ParamsA, ParamsB
weave_6 = Weave(Pattern=[0, 1], Stream0=ccx_3.Points, Stream1=ccx.Points, NullGaps=False)
pline_5 = PolyLine(Vertices=weave_6, Closed=False)
explode_10 = Explode(Curve=cluster_10, Recursive=True)  # -> Segments, Vertices
Z_14 = UnitZ(Factor=1)
end_7 = EndPoints(Curve=explode_10.Segments)  # -> graft(Start), graft(End)
len_2 = Length(Curve=explode_10.Segments)
vec2pt_6 = Vector2Pt(PointA=end_7.Start, PointB=end_7.End, Unitize=False)  # -> Vector, Length
sort_10 = SortList(Keys=len_2, ValuesA=explode_10.Segments)  # -> Keys, ValuesA
angle_6 = Angle(VectorA=vec2pt_6.Vector, VectorB=Z_14)  # -> Angle, Reflex
cull_i_5 = CullIndex(List=sort_10.ValuesA, Indices=Slider(0, range=0..100), Wrap=True)

# ---- group: SupportColumns/Exostruc
filter_15 = StreamFilter(Gate=Slider(0, range=0..100), Stream0=explode_10.Segments, Stream1=explode_9.Segments)

# ----
deg_5 = Degrees(Radians=angle_6.Angle)
end_8 = EndPoints(Curve=explode_10.Segments)  # -> graft(Start), graft(End)
Z_15 = UnitZ(Factor=1)
round_7 = Round(Number=deg_5)  # -> Nearest, Floor, Ceiling
vec2pt_7 = Vector2Pt(PointA=end_8.Start, PointB=end_8.End, Unitize=False)  # -> Vector, Length
equals_5 = Equality(FirstNumber=round_7.Nearest, SecondNumber=Slider(90, range=0..100))  # -> Equality, Inequality
angle_7 = Angle(VectorA=vec2pt_7.Vector, VectorB=Z_15)  # -> Angle, Reflex
cull_15 = CullPattern(List=graft(filter_15), CullPattern=invert(equals_5.Equality))
cull_16 = CullPattern(List=graft(filter_15), CullPattern=equals_5.Equality)
deg_6 = Degrees(Radians=angle_7.Angle)
round_8 = Round(Number=deg_6)  # -> Nearest, Floor, Ceiling
equals_6 = Equality(FirstNumber=round_8.Nearest, SecondNumber=Slider(90, range=0..100))  # -> Equality, Inequality
pshift_17 = ShiftPaths(Data=cull_15, Offset=-1)
cull_17 = CullPattern(List=graft(explode_7.Segments), CullPattern=invert(equals_4.Equality))
cull_18 = CullPattern(List=graft(explode_10.Segments), CullPattern=equals_6.Equality)
cull_19 = CullPattern(List=graft(explode_10.Segments), CullPattern=invert(equals_6.Equality))
cull_20 = CullPattern(List=graft(explode_9.Segments), CullPattern=equals_6.Equality)
pshift_18 = ShiftPaths(Data=cull_17, Offset=Slider(-3, range=-10..0))
pshift_19 = ShiftPaths(Data=cull_17, Offset=Slider(-2, range=-10..0))
pshift_20 = ShiftPaths(Data=cull_20, Offset=Slider(-4, range=-10..0))
item_25 = ListItem(List=pshift_19, Index=0, Wrap=True)  # -> Item, Item1
tstat_12 = TreeStatistics(Tree=pshift_18)  # -> Paths, Length, Count
ccx_5 = CurveCurve(CurveA=item_25.Item, CurveB=item_25.Item1)  # -> Points, ParamsA, ParamsB
panel_17 = Panel("""True
False""")
pshift_21 = ShiftPaths(Data=simplify(ccx_5.Points), Offset=-1)
repeat_7 = RepeatData(Data=panel_17, Length=tstat_12.Count)

num_2 = Number(entwine_4)

num_3 = Number(entwine_3)

num_4 = Number(Slider(0.7, range=0..3))
num_5 = Number(Slider(0.7, range=0..3))
cull_21 = CullPattern(List=tstat_12.Paths, CullPattern=invert(repeat_7))
cull_22 = CullPattern(List=tstat_12.Paths, CullPattern=invert(repeat_7))
cull_23 = CullPattern(List=tstat_12.Paths, CullPattern=repeat_7)
cull_24 = CullPattern(List=tstat_12.Paths, CullPattern=repeat_7)
branch_21 = TreeBranch(Tree=pshift_18, Path=cull_24, MaintainPaths=True)
branch_22 = TreeBranch(Tree=pshift_20, Path=cull_23, MaintainPaths=True)
branch_23 = TreeBranch(Tree=pshift_18, Path=cull_22, MaintainPaths=True)
branch_24 = TreeBranch(Tree=pshift_20, Path=cull_21, MaintainPaths=True)
branch_25 = TreeBranch(Tree=pshift_21, Path=cull_23, MaintainPaths=True)
branch_26 = TreeBranch(Tree=pshift_21, Path=cull_21, MaintainPaths=True)
flip_3 = FlipCurve(Curve=branch_22)  # -> Curve, Flag
flip_4 = FlipCurve(Curve=branch_24)  # -> Curve, Flag
eval_3 = EvaluateLength(Curve=branch_24, Length=graft(num_5), Normalized=False)  # -> Point, Tangent, Parameter
eval_4 = EvaluateLength(Curve=branch_22, Length=graft(num_4), Normalized=False)  # -> Point, Tangent, Parameter
eval_5 = EvaluateLength(Curve=flip_3.Curve, Length=graft(num_4), Normalized=False)  # -> Point, Tangent, Parameter
eval_6 = EvaluateLength(Curve=flip_4.Curve, Length=graft(num_5), Normalized=False)  # -> Point, Tangent, Parameter
tstat_13 = TreeStatistics(Tree=branch_22)  # -> Paths, Length, Count
tstat_14 = TreeStatistics(Tree=branch_24)  # -> Paths, Length, Count
merge_17 = Merge(Data1=simplify(graft(eval_4.Point)), Data2=simplify(graft(branch_25)), Data3=simplify(graft(eval_5.Point)))
item_26 = ListItem(List=tstat_13.Paths, Index=0, Wrap=True)  # -> Item, Item1, Item2, Item3, Item4, Item5
merge_18 = Merge(Data1=simplify(graft(eval_3.Point)), Data2=simplify(graft(branch_26)), Data3=simplify(graft(eval_6.Point)))
item_27 = ListItem(List=tstat_14.Paths, Index=0, Wrap=True)  # -> Item, Item1, Item2, Item3, Item4, Item5
branch_27 = TreeBranch(Tree=branch_21, Path=item_26.Item5, MaintainPaths=True)
branch_28 = TreeBranch(Tree=branch_23, Path=item_27.Item5, MaintainPaths=True)
cir = Circle(Plane=eval_5.Point, Radius=graft(num_4))
pline_6 = PolyLine(Vertices=merge_17, Closed=False)
pline_7 = PolyLine(Vertices=merge_18, Closed=False)
merge_19 = Merge(Data1=pline_7, Data2=pline_6)
explode_11 = Explode(Curve=merge_19, Recursive=True)  # -> Segments, Vertices
number_slider_29 = Slider(6, range=0..10)

crv_6 = Curve(explode_11.Segments)
crv_7 = Curve(pshift_17)

ext_3 = ExtendCurve(Curve=crv_6, Type=0, Start=number_slider_29, End=number_slider_29)
srfsplit = SurfaceSplit(Surface=graft(entwine_2), Curves=ext_3)
area_10 = Area(Geometry=graft(entwine_2))  # -> Area, Centroid
area_11 = Area(Geometry=srfsplit)  # -> Area, Centroid
srf_cp = SurfaceClosestPoint(Point=area_10.Centroid, Surface=srfsplit)  # -> Point, UVPoint, Distance
sort_11 = SortList(Keys=area_11.Area, ValuesA=srfsplit)  # -> Keys, ValuesA
sort_12 = SortList(Keys=srf_cp.Distance, ValuesA=srfsplit)  # -> Keys, ValuesA
panel_18 = Panel(sort_12.Keys)
lng_3 = ListLength(List=sort_11.ValuesA)  # -> expr("x-1", Length)
item_28 = ListItem(List=sort_12.ValuesA, Index=0, Wrap=True)
pshift_22 = ShiftPaths(Data=cull_16, Offset=-1)
item_29 = ListItem(List=pshift_17, Index=0, Wrap=True)  # -> Item, Item1
wires_4 = BrepWireframe(Brep=item_28, Density=-1)
eval_7 = EvaluateCurve(Curve=reparameterize(pshift_22), Parameter=Slider(0.5, range=0..1))  # -> Point, Tangent, Angle
ccx_6 = CurveCurve(CurveA=item_29.Item, CurveB=item_29.Item1)  # -> Points, ParamsA, ParamsB
join_7 = JoinCurves(Curves=wires_4, Preserve=False)
srfsplit_2 = SurfaceSplit(Surface=graft(entwine_2), Curves=join_7)
srf_cp_2 = SurfaceClosestPoint(Point=area_10.Centroid, Surface=srfsplit_2)  # -> Point, UVPoint, Distance
ln_10 = Line(StartPoint=eval_7.Point, EndPoint=ccx_6.Points)
area_12 = Area(Geometry=srfsplit_2)  # -> Area, Centroid
sort_13 = SortList(Keys=srf_cp_2.Distance, ValuesA=srfsplit_2)  # -> Keys, ValuesA
sort_14 = SortList(Keys=area_12.Area, ValuesA=srfsplit_2)  # -> Keys, ValuesA
lng_4 = ListLength(List=sort_13.ValuesA)  # -> expr("x-1", Length)
amp_2 = Amplitude(Vector=graft(merge_12), Amplitude=Slider(0.8, range=0..10))
item_30 = ListItem(List=sort_13.ValuesA, Index=lng_4, Wrap=True)
wires_5 = BrepWireframe(Brep=item_30, Density=-1)
amp_3 = Amplitude(Vector=graft(merge_12), Amplitude=Slider(1.4, range=0..10))
move_10 = Move(Geometry=ln_10, Motion=amp_2)  # -> Geometry, Transform
join_8 = JoinCurves(Curves=wires_5, Preserve=False)
extr_2 = Extrude(Base=item_30, Direction=graft(amp_3))
disc_2 = Discontinuity(Curve=reparameterize(join_8), Level=1)  # -> Points, Parameters
brep_2 = Brep(flatten(extr_2))
mjoin_3 = MeshJoin(Meshes=flatten(del_2))
shatter = Shatter(Curve=reparameterize(join_8), Parameters=disc_2.Parameters)
mesh_2 = MeshBrep(
    Brep=extr_2,
    Settings={GridMaxCount=0, GridMinCount=16, JaggedSeams=False, MaxEdgeLength=0, MinEdgeLength=0.0001, MinTolerance=0, Refine=True, RefineAngle=0, RelativeTolerance=0.65, SimplePlanes=True, Tolerance=0})
duppt_4 = RemoveDuplicatePts(Points=disc_2.Points, Tolerance=0.01)
len_3 = Length(Curve=shatter)
flipm = FlipMesh(Mesh=mjoin_3, VertexNormals=True, FaceNormals=True, FaceOrientation=True)
sort_15 = SortList(Keys=len_3, ValuesA=shatter)  # -> Keys, ValuesA
mjoin_4 = MeshJoin(Meshes=flatten(mesh_2))
shift_18 = ShiftList(List=sort_15.ValuesA, Shift=Slider(2, range=0..10), Wrap=False)
weldvertices = MeshWeldVertices(Mesh=mjoin_4, Tolerance=0.01)  # -> RuntimeMessage, Mesh
join_9 = JoinCurves(Curves=shift_18, Preserve=False)
mesh_3 = MeshBrep(
    Brep=join_3.Breps,
    Settings={GridMaxCount=0, GridMinCount=16, JaggedSeams=False, MaxEdgeLength=0, MinEdgeLength=0.0001, MinTolerance=0, Refine=True, RefineAngle=0, RelativeTolerance=0.65, SimplePlanes=True, Tolerance=0})
weld = WeldMesh(Mesh=weldvertices.Mesh, Angle=3.141592654)
panel_19 = Panel(brep_2)
len_4 = Length(Curve=join_9)
loft_6 = Loft(Curves=join_9, Options={Adjust=True, Closed=False, LoftEnds=0, LoftSimp=0, LoftType=3, Rebuild=10, Refit=0.01})
smesh = SimpleMesh(Brep=loft_6)  # -> flatten(Mesh)
sort_16 = SortList(Keys=len_4, ValuesA=join_9)  # -> Keys, ValuesA
mjoin_5 = MeshJoin(Meshes=flatten([mesh, mesh_3]))
smesh_2 = SimpleMesh(Brep=join_3.Breps)
debrep_2 = DeconstructBrep(Brep=loft_6)  # -> Faces, Edges, Vertices
item_31 = ListItem(List=sort_16.ValuesA, Index=0, Wrap=True)
explode_12 = Explode(Curve=item_31, Recursive=True)  # -> Segments, Vertices
mesh_4 = Mesh([item_19.Item, item_19.Item1])
xz_3 = XZPlane(Origin=Point(0, 0, 0))
wbsplitquads = WeaverbirdsConstantQuadsSplitSubdivision(Level=1, SmoothNakedEdges=1)
pflip = FlipPlane(Plane=xz_3, ReverseX=False, ReverseY=True, SwapAxes=False)
mjoin_6 = MeshJoin(Meshes=flatten([smesh_2, mesh_4]))
number_slider_30 = Slider(0.1, range=0..0.1)
number_slider_31 = Slider(1, range=0..1000)
orient = Orient(Geometry=mjoin_5, Source=PlaneXY(0, 0, 0), Target=pflip)  # -> Geometry, Transform
wbthicken = WeaverbirdsMeshThicken(Distance=Slider(0.2, range=0..1), OffsetType=0)
mjoin_7 = MeshJoin(Meshes=orient.Geometry)
scale = Scale(Geometry=mjoin_7, Center=Point(0, 0, 0), Factor=Slider(0.3, range=0..1))  # -> Geometry, Transform
c_script = CSharpScript(m=mjoin_7)  # -> out, A; inputs m: Mesh
# ---------- c_script: C# usings ----------
using System.IO;
using System.Linq;
using System.Data;
using System.Drawing;
using System.Reflection;
using System.Windows.Forms;
using System.Xml;
using System.Xml.Linq;
using System.Runtime.InteropServices;

using Rhino.DocObjects;
using Rhino.Collections;
using GH_IO;
using GH_IO.Serialization;
# ---------- c_script: C# ----------
    A = Mesh.CreateFromSubD(SubD.CreateFromMesh(m), 0);
# ---------- end c_script ----------
# using System;
# using System.Collections.Generic;
# using System.Linq;
# using System.Web;
# 
# namespace Resthopper.Models
# {
#     public enum GHTypeCodes
#     {
#         Boolean = 101,
#         Point = 102,
#         Vector = 103,
#         Integer = 104,
#         Number = 105,
#         Text = 106,
#         Line = 107,
#         Curve = 108,
#         Circle = 109,
#         PLane = 110,
#         Rectangle = 111,
#         Box = 112,
#         Surface = 113,
#         Brep = 114,
#         Mesh = 115,
# 
#         Slider = 201,
#         BooleanToggle = 202,
# 
#         Panel = 301
# 
#         //gh_boolean = 1,
#         //gh_byte = 2,
#         //gh_int = 3,
#         //gh_long = 4,
#         //gh_float = 5,
#         //gh_double = 6,
#         //gh_decimal = 7,
#         //gh_DateTime = 8,
#         //gh_Guid = 9,
#         //gh_string = 10,
#         //gh_byteArray = 20,
#         //gh_doubleArray = 21,
#         //gh_SystemDrawingPoint = 30,
#         //gh_SystemDrawingPointF = 31,
#         //gh_SystemDrawingSize = 32,
#         //gh_SystemDrawngSizeF = 33,
#         //gh_SystemDrawingRectangleF = 35,
#         //gh_SystemDrawingColor = 36,
#         //gh_SystemDrawingBitmap = 37,
#         //gh_GH_IO_2dPoint = 50,
#         //gh_GH_IO_3dPoint = 51,
#         //gh_GH_IO_4dPoint = 52,
#         //gh_GH_IO_1dInterval = 60,
#         //gh_GH_IO_2dInterval = 61,
#         //gh_GH_IO_line = 70,
#         //gh_GH_IO_BoundingBox = 71,
#         //gh_GH_IO_Plane = 72,
#         //gh_GH_IO_version = 80
# 
#     }
# }
flipm_2 = FlipMesh(Mesh=c_script.A, VertexNormals=True, FaceNormals=True, FaceOrientation=True)
mplane = MeshPlane(Boundary={Plane=PlaneXY(0, 0, 0), Size=Domain2(u=-10..10, v=-10..10)}, WidthCount=10, HeightCount=10)  # -> Mesh, Area
flipm_3 = FlipMesh(Mesh=mjoin_7, VertexNormals=True, FaceNormals=True, FaceOrientation=True)
msphere = MeshSphere(Base=PlaneXY(0, 0, 0), Radius=10, UCount=10, VCount=20)

# ---- group: RH_OUT:115:Mesh_TRC
mesh_5 = Mesh(flipm_3)

# ----
panel_20 = Panel(mesh_5)
wbjoin = WeaverbirdsJoinMeshesAndWeld(Weld=True)
wbthicken_2 = WeaverbirdsMeshThicken(Distance=5, OffsetType=0)
wbcatmullclark = WeaverbirdsCatmullClarkSubdivision(MeshCurves=wbsplitquads, Level=1, SmoothNakedEdges=1)
wbcatmullclark_2 = WeaverbirdsCatmullClarkSubdivision(MeshCurves=wbthicken_2, Level=1, SmoothNakedEdges=1)

# ==== cluster Cluster
crv = ClusterInput()
num = ClusterInput()
crv_2 = Curve(crv)
num_2 = Number(num)
offset = OffsetCurve(Curve=crv_2, Distance=num_2, Plane=PlaneXY(0, 0, 0), Corners=1)
area = Area(Geometry=crv_2)  # -> Area, Centroid
area_2 = Area(Geometry=offset)  # -> Area, Centroid
eval = Evaluate(F="x<y", x=area.Area, y=area_2.Area)
cull = CullPattern(List=crv_2, CullPattern=invert(eval))
cull_2 = CullPattern(List=offset, CullPattern=eval)
neg = Negative(Value=num_2)
offset_2 = OffsetCurve(Curve=cull, Distance=neg, Plane=PlaneXY(0, 0, 0), Corners=1)
merge = Merge(Data1=simplify(offset_2), Data2=simplify(cull_2))
R = ClusterOutput(merge)

# ==== cluster Cluster_2
crv = ClusterInput()
num = ClusterInput()
crv_2 = Curve(crv)
num_2 = Number(num)
offset = OffsetCurve(Curve=crv_2, Distance=num_2, Plane=PlaneXY(0, 0, 0), Corners=1)
area = Area(Geometry=crv_2)  # -> Area, Centroid
area_2 = Area(Geometry=offset)  # -> Area, Centroid
eval = Evaluate(F="x<y", x=area.Area, y=area_2.Area)
cull = CullPattern(List=offset, CullPattern=invert(eval))
cull_2 = CullPattern(List=crv_2, CullPattern=eval)
neg = Negative(Value=num_2)
offset_2 = OffsetCurve(Curve=cull_2, Distance=neg, Plane=PlaneXY(0, 0, 0), Corners=1)
merge = Merge(Data1=simplify(offset_2), Data2=simplify(cull))
R = ClusterOutput(merge)

# ==== cluster Cluster_3
G = ClusterInput()
crv = ClusterInput()
num = ClusterInput()
crv_2 = Curve(crv)
num_2 = Number(num)
offset = OffsetCurve(Curve=crv_2, Distance=num_2, Plane=PlaneXY(0, 0, 0), Corners=1)
area = Area(Geometry=crv_2)  # -> Area, Centroid
area_2 = Area(Geometry=offset)  # -> Area, Centroid
eval = Evaluate(F="x<y", x=area.Area, y=area_2.Area)
not = GateNot(A=eval)
filter = StreamFilter(Gate=G, Stream0=eval, Stream1=not)
cull = CullPattern(List=crv_2, CullPattern=invert(filter))
cull_2 = CullPattern(List=offset, CullPattern=filter)
neg = Negative(Value=num_2)
offset_2 = OffsetCurve(Curve=cull, Distance=neg, Plane=PlaneXY(0, 0, 0), Corners=1)
merge = Merge(Data1=simplify(offset_2), Data2=simplify(cull_2))
R = ClusterOutput(merge)
