# Grasshopper definition Sphere_Test_01.gh (Grasshopper 1.0.7)

# ---- group: RH_IN:Radius
number_slider = Slider(5.273, range=0..10)

# ----
sph = Sphere(Base=PlaneXY(0, 0, 0), Radius=number_slider)
mesh = MeshBrep(
    Brep=sph,
    Settings={GridMaxCount=0, GridMinCount=16, JaggedSeams=False, MaxEdgeLength=0, MinEdgeLength=0.0001, MinTolerance=0, Refine=True, RefineAngle=0, RelativeTolerance=0.65, SimplePlanes=True, Tolerance=0})

# ---- group: RH_OUT:Sphere
mesh_2 = Mesh(mesh)
